# Grasshopper definition OpenNest_Multiple_Examples_200201.gh (Grasshopper 1.0.7)
# plug-ins: OpenNest

# ----
# Text with Custom Fonts + Bin Packing
panel = Panel("Cepelinai is the national dish of Lithuania")
xy = XYPlane(Origin=Point(0, 0, 0))
text = Text(Location=xy, Text=panel, Size=Slider(10, range=0..10), Font="Arial 1 1")

# ----
# If you want to unroll simple geometry
brep = Brep([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])
unroll = Unroll(MeshOrBrep=brep)  # -> Brep, Curves, Points, TextDotsLocation, TextDots

number_slider = Slider(100, range=0..100)  # disabled
pt = Point([Point(2996.711041, -126806.1032, 40560.84165), Point(-54020.40312, -112027.8866, 29623.7197), Point(17112.92353, -140890.7998, 88973.2794), Point(-27029.74655, -139012.0835, 39759.22902), Point(-5795.822672, -151383.4955, 63224.36), Point(-18434.71631, -115756.3915, 20462.05343)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])

# ----
# Text for engraving
pop2d = Populate2D(Region={Plane=PlaneXY(0, 0, 0), Size=Domain2(u=0..20, v=0..10)}, Count=100, Seed=1)
pdecon = Deconstruct(Point=pop2d)  # -> XComponent, YComponent, ZComponent
round = Round(Number=pdecon.XComponent)  # -> Nearest, Floor, Ceiling
text_2 = Text(Location=pop2d, Text=round.Nearest, Size=1)

# ---- group: This projects polygons to plane
crv = Curve([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])
project = Project(Polyline=crv)  # -> Polyline, Plane
pack = PackObjects(Geo=project.Polyline, Plane=project.Plane, X=1, Y=1, Tolerabce=3.14)  # -> Geo, Transformation

# ----
brep_2 = Brep(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)
brep_3 = Brep([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])

# ----
# If you just want to pack object into rectangle array
pln = Plane([Plane(origin=(177.2966553, -26.65196411, 44.30150529), x=(0, -1, 0), y=(-1, 0, 0)), Plane(origin=(236.1676684, -43.9024936, 40.92366467), x=(-0.4373626862, 0, -0.8992852054), y=(0, -1, 0)), Plane(origin=(206.5526304, -164.2693558, 0), x=(-0.7706951683, -0.6372040156, 0), y=(0.6372040156, -0.7706951683, 0)), Plane(origin=(268.3124917, -156.3636782, 0), x=(0.7372204611, 0.6756522713, 0), y=(0.6756522713, -0.7372204611, 0))])  # disabled
# Some additional helpers:
geo = Geometry([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])  # disabled
number_slider_2 = Slider(8, range=0..100)  # disabled
number_slider_3 = Slider(53, range=0..100)  # disabled
entwine = Entwine(Branch00=pln, Branch01=pln, FlattenInputs=True)  # disabled
entwine_2 = Entwine(Branch00=geo, Branch01=geo, FlattenInputs=True)  # disabled
pack_2 = PackObjects(Geo=entwine_2, Plane=entwine, X=number_slider_2, Y=number_slider_3, Tolerabce=3.14)  # -> Geo, Transformation; disabled

number_slider_4 = Slider(0.5, range=0..1)  # disabled
pca = PCAComponent(P=pt)  # -> Box, Mesh, Line, Plane, Plane_2
packbox = PackingBoxes(Con=brep_2, Geo=brep_3, CD=0)  # -> Geo, Tra
number_slider_5 = Slider(10, range=0..10)  # disabled
crv_2 = Curve(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)  # disabled

# ----
# Box Packing
brep_4 = Brep([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])
hull = Hull(Brep=brep_4)  # -> G, C, H, P0, P1
cp = ControlPoints(Curve=hull.H)  # -> Points, Weights, Knots
hull_2 = ConvexHull(Points=cp.Points, Plane=PlaneXY(0, 0, 0))  # -> Hull, HullZ, Indices
offset = OffsetCurve(Curve=hull_2.Hull, Distance=Slider(19, range=0..100), Plane=PlaneXY(0, 0, 0), Corners=1)  # -> flatten(Curve)
crv_3 = Curve(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)
packbox_2 = PackingBoxes(Con=crv_3, Geo=offset, CD=0)  # -> Geo, Tra
transform = Transform(Geometry=hull.G, Transform=graft(packbox_2.Tra))
debrep = DeconstructBrep(Brep=transform)  # -> Faces, Edges, Vertices; disabled
number_slider_6 = Slider(500, range=0..1000)  # disabled
join = JoinCurves(Curves=debrep.Edges, Preserve=False)  # -> flatten(Curves); disabled
len = Length(Curve=join)  # disabled
larger = LargerThan(FirstNumber=len, SecondNumber=number_slider_6)  # -> LargerThan, OrEqualTo; disabled
dispatch = Dispatch(List=join, DispatchPattern=larger.LargerThan)  # -> ListA, ListB; disabled
partition = PartitionList(List=dispatch.ListB, Size=2)  # disabled
area = Area(Geometry=partition)  # -> Area, Centroid; disabled
pline = PolyLine(Vertices=area.Centroid, Closed=False)  # disabled
drilllines = Curve(pline)  # disabled
cutting_lines = Curve(dispatch.ListA)  # disabled

# ----
# Box Packing Multiple Containers
crv_4 = Curve([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])
crv_5 = Curve([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])
crv_6 = Curve([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])
packbox_3 = PackingBoxes(Con=crv_6, Geo=crv_4, CD=0)  # -> Geo, Tra
transform_2 = Transform(Geometry=crv_5, Transform=packbox_3.Tra)

# ----
# Basic Setup
# Nesting Polylines
crv_7 = Curve(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)
opennest = OpenNest(
    Sheets=crv_7,
    Geo=pack.Geo,
    Spacing=1,
    Placement=1,
    Tolerance=0.1,
    Rotations=4,
    Iterations=1,
    Seed=1,
    Reset=True,
    Run=False)  # -> Sheets, Geo, ID, Transform, IDS

repeat = RepeatData(Data=crv_2, Length=number_slider)  # disabled
series = Series(Start=0, Step=1, Count=number_slider)  # disabled
pt_2 = ConstructPoint(XCoordinate=number_slider_4, YCoordinate=number_slider_4, ZCoordinate=0)  # disabled
brep_5 = Brep([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])  # disabled
pop2d_2 = Populate2D(Region=repeat, Count=number_slider_5, Seed=series)  # disabled
evalsrf = EvaluateSurface(Surface=reparameterize(brep_5), Point=pt_2)  # -> Point, Normal, UDirection, VDirection, Frame; disabled

brep_6 = Brep(graft([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]))
scale = Scale(Geometry=brep_6, Center=Point(0, 0, 0), Factor=Slider(0.01, range=0..0.01))  # -> Geometry, Transform
unroll_2 = Unroll(MeshOrBrep=scale.Geometry)  # -> Brep, Curves, Points, TextDotsLocation, TextDots
brep_7 = Brep(flatten(unroll_2.Brep))
partition_2 = PartitionList(List=brep_7, Size=Slider(10, range=0..10))
area_2 = Area(Geometry=partition_2)  # -> Area, Centroid
pack_3 = PackObjects(Geo=partition_2, Plane=area_2.Centroid, X=Slider(0.01, range=0..0.01), Y=Slider(0.47, range=0..2.01), Tolerabce=0)  # -> Geo, Transformation

lng = ListLength(List=evalsrf.Point)  # disabled
number_slider_7 = Slider(43, range=0..100)  # disabled
hull_3 = ConvexHull(Points=pop2d_2, Plane=PlaneXY(0, 0, 0))  # -> flatten(Hull), HullZ, Indices; disabled
pl = PlaneNormal(Origin=evalsrf.Point, ZAxis=evalsrf.Normal)  # disabled
pca_2 = PCAComponent(P=pop2d_2)  # -> Box, Mesh, Line, Plane, Plane_2; disabled
series_2 = Series(Start=0, Step=1, Count=lng)  # disabled

# ---- group: This projects polygons to plane
crv_8 = Curve([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])
project_2 = Project(Polyline=crv_8)  # -> Polyline, Plane
pack_4 = PackObjects(Geo=project_2.Polyline, Plane=project_2.Plane, X=1, Y=1, Tolerabce=3.14)  # -> Geo, Transformation

# ----
text_3 = Text(Location=pl, Text=series_2, Size=number_slider_7)  # disabled
orient = Orient(Geometry=hull_3.Hull, Source=flatten(pca_2.Plane), Target=PlaneXY(0, 0, 0))  # -> Geometry, Transform; disabled
number_slider_8 = Slider(1660, range=0..1660)  # disabled

# ----
# Nesting To Arbitrary Sheets
crv_9 = Curve([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])
opennest_2 = OpenNest(
    Sheets=crv_9,
    Geo=pack_4.Geo,
    Spacing=1,
    Placement=1,
    Tolerance=0.1,
    Rotations=4,
    Iterations=1,
    Seed=1,
    Reset=True,
    Run=False)  # -> Sheets, Geo, ID, Transform, IDS

crv_10 = Curve(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)  # disabled
unroll_3 = Unroll(MeshOrBrep=brep_5, Points=evalsrf.Point, Text=series_2, TextPoint=evalsrf.Point)  # -> Brep, Curves, Points, TextDotsLocation, TextDots; disabled
number_slider_9 = Slider(43, range=0..100)  # disabled
packbox_4 = PackingBoxes(Con=crv_10, Geo=orient.Geometry, CD=number_slider_8)  # -> Geo, Tra; disabled
crv_11 = Curve(packbox_4.Geo)  # disabled
transform_3 = Transform(Geometry=orient.Geometry, Transform=packbox_4.Tra)  # disabled
text_4 = Text(Location=unroll_3.TextDotsLocation, Text=unroll_3.TextDots, Size=number_slider_9)  # disabled
edges = BrepEdges(Brep=packbox_4.Geo)  # -> Naked, Interior, NonManifold; disabled
geo_2 = Geometry(unroll_3.Brep)  # disabled

# ----
# If you want nest rhino objects
# Reference them as guids,
# convert to polylines
# And then press boolean button to bake them
number_slider_10 = Slider(3, range=0..10)  # disabled
id = Guid()  # disabled
crv_12 = Curve(<curve referenced from the Rhino model>)  # disabled
crv_13 = Curve(id)  # disabled
opennest_3 = OpenNest(
    Sheets=crv_12,
    Geo=crv_13,
    Spacing=1,
    Placement=number_slider_10,
    Tolerance=0.1,
    Rotations=4,
    Iterations=1,
    Seed=1,
    Reset=True,
    Run=False)  # -> Sheets, Geo, ID, Transform, IDS; disabled
button = Button()  # disabled
tguid = TransformGuid(Guid=id, Transform=opennest_3.Transform, Run=button)  # disabled

# ----
# Nest Rhino Objects
number_slider_11 = Slider(2, range=0..10)  # disabled
id_2 = Guid()  # disabled
rhinoobjects = RhinoObjects(GeometryAsGuid=id_2, T=number_slider_11)  # -> Breps, GeometryAsGuid; disabled
number_slider_12 = Slider(0.01, range=0..0.01)  # disabled
number_slider_13 = Slider(0.3, range=0..10)  # disabled
crv_14 = Curve(<curve referenced from the Rhino model>)  # disabled
opennest_4 = OpenNest(
    Sheets=crv_14,
    Geo=rhinoobjects.Breps,
    Spacing=number_slider_13,
    Placement=1,
    Tolerance=number_slider_12,
    Rotations=4,
    Iterations=1,
    Seed=1,
    Reset=True,
    Run=False)  # -> Sheets, Geo, ID, Transform, IDS; disabled
id_3 = Guid(rhinoobjects.GeometryAsGuid)  # disabled
button_2 = Button()  # disabled
tguid_2 = TransformGuid(Guid=id_3, Transform=graft(opennest_4.Transform), Run=button_2)  # disabled

boundary = BoundarySurfaces(Edges=transform_3)  # disabled

# ---- group: Parts can be either polylines or planar surfaces
number_slider_14 = Slider(100, range=0..100)  # disabled
number_slider_15 = Slider(2, range=0..10)  # disabled
crv_15 = Curve([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])  # disabled
boundary_2 = BoundarySurfaces(Edges=crv_15)  # disabled
crv_16 = Curve(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)  # disabled
repeat_2 = RepeatData(Data=boundary_2, Length=number_slider_15)  # disabled
repeat_3 = RepeatData(Data=crv_16, Length=number_slider_14)  # disabled
merge = Merge(Data1=repeat_2, Data2=repeat_3)  # -> flatten(Result); disabled

# ----
# Nesting Shape with Holes -> Planar Surfaces
crv_17 = Curve(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)  # disabled
area_3 = Area(Geometry=merge)  # -> Area, Centroid; disabled
number_slider_16 = Slider(2, range=0..10)  # disabled
lng_2 = ListLength(List=area_3.Centroid)  # disabled
opennest_5 = OpenNest(
    Sheets=crv_17,
    Geo=merge,
    Spacing=1,
    Placement=1,
    Tolerance=0.1,
    Rotations=4,
    Iterations=1,
    Seed=1,
    Reset=True,
    Run=False)  # -> Sheets, Geo, ID, Transform, IDS; disabled
series_3 = Series(Start=0, Step=1, Count=lng_2)  # disabled
int = Integer(series_3)  # disabled
text_5 = Text(Location=area_3.Centroid, Text=int, Size=number_slider_16)  # disabled
group = Group(Objects=text_5)  # -> flatten(Group); disabled

# ---- group: If you want to nest additional goemetry
transform_4 = Transform(Geometry=group, Transform=opennest_5.Transform)  # disabled

# ----
# Unroll + Nest
brep_8 = Brep([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])  # disabled
area_4 = Area(Geometry=brep_8)  # -> Area, Centroid; disabled
unroll_4 = Unroll(MeshOrBrep=brep_8, Points=area_4.Centroid)  # -> flatten(Brep), Curves, flatten(Points), TextDotsLocation, TextDots; disabled
number_slider_17 = Slider(0, range=0..100)  # disabled
crv_18 = Curve(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)  # disabled
opennest_6 = OpenNest(
    Sheets=crv_18,
    Geo=unroll_4.Brep,
    Spacing=number_slider_17,
    Placement=1,
    Tolerance=0.1,
    Rotations=4,
    Iterations=1,
    Seed=1,
    Reset=True,
    Run=False)  # -> Sheets, Geo, ID, Transform, IDS; disabled
transform_5 = Transform(Geometry=unroll_4.Points, Transform=opennest_6.Transform)  # disabled
points = PointList(Points=transform_5, Size=2)  # disabled

# ----
# Nesting Curves
# Internally component converts curves to polylines.
# Suggestion to convert to polylines.
number_slider_18 = Slider(30, range=0..100)  # disabled
toggle = BooleanToggle(True)  # disabled
toggle_2 = BooleanToggle(True)  # disabled
number_slider_19 = Slider(0.1, range=0..0.1)  # disabled
number_slider_20 = Slider(4, range=0..10000)  # disabled
number_slider_21 = Slider(1, range=0..100)  # disabled
number_slider_22 = Slider(5, range=0..10)  # disabled
number_slider_23 = Slider(4, range=0..5)  # disabled
number_slider_24 = Slider(1, range=0..100)  # disabled
number_slider_25 = Slider(2, range=0..10)  # disabled
crv_19 = Curve([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])  # disabled
repeat_4 = RepeatData(Data=crv_19, Length=number_slider_18)  # disabled
crv_20 = Curve(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)  # disabled
opennest_7 = OpenNest(
    Sheets=crv_20,
    Geo=repeat_4,
    Spacing=number_slider_21,
    Placement=number_slider_23,
    Tolerance=number_slider_19,
    Rotations=number_slider_20,
    Iterations=number_slider_24,
    Seed=number_slider_25,
    Reset=toggle,
    Run=toggle_2)  # -> Sheets, Geo, ID, Transform, IDS; disabled

# ----
# Nesting Breps and Meshes
toggle_3 = BooleanToggle(True)  # disabled
toggle_4 = BooleanToggle(True)  # disabled
number_slider_26 = Slider(0.1, range=0..0.1)  # disabled
number_slider_27 = Slider(1, range=0..100)  # disabled
number_slider_28 = Slider(5, range=0..10)  # disabled
number_slider_29 = Slider(4, range=0..5)  # disabled
number_slider_30 = Slider(4, range=0..10000)  # disabled
number_slider_31 = Slider(1, range=0..100)  # disabled
number_slider_32 = Slider(2, range=0..10)  # disabled
geo_3 = Geometry([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])  # disabled
crv_21 = Curve(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)  # disabled
crv_22 = Curve([<curve referenced from the Rhino model> x2])  # disabled
opennest_8 = OpenNest(
    Sheets=crv_21,
    Geo=geo_3,
    Spacing=number_slider_27,
    Placement=number_slider_29,
    Tolerance=number_slider_26,
    Rotations=number_slider_30,
    Iterations=number_slider_31,
    Seed=number_slider_32,
    Reset=toggle_3,
    Run=toggle_4)  # -> Sheets, Geo, ID, Transform, IDS; disabled

# ---- group: Must be set to 0 to run live
number_slider_33 = Slider(0, range=0..100)  # disabled

# ----
# Running Solver Iteratively.
# Only the most optimcal results
# are outputed
button_3 = Button()  # disabled
toggle_5 = BooleanToggle(False)  # disabled
crv_23 = Curve(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)  # disabled
crv_24 = Curve([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])  # disabled
opennest_9 = OpenNest(
    Sheets=crv_23,
    Geo=crv_24,
    Spacing=1,
    Placement=1,
    Tolerance=0.1,
    Rotations=4,
    Iterations=number_slider_33,
    Seed=1,
    Reset=button_3,
    Run=toggle_5)  # -> Sheets, Geo, ID, Transform, IDS; disabled

# ----
# Nest Rhino Objects as curves
# Once you press Run to false
# Press this button to bake
# geometry
id_4 = Guid([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])  # disabled
c_script = CSharpScript(G=id_4)  # -> out, simplify(graft(A)), simplify(B); inputs G: list of Guid; disabled
# ---------- c_script: C# ----------
    var result = SortGuidsByPlanarCurves(G, 0.01);
    A = result.Item1;
    B = DictioryToTree(result.Item2);
# ---------- c_script: C# additional code ----------
    public DataTree<Guid> DictioryToTree<Guid>( Dictionary<int,List<Guid>> list, int iteration = 0) {
      DataTree<Guid> tree = new DataTree<Guid>();
  
      foreach (var a in list)
        tree.AddRange(a.Value,new GH_Path(a.Key));
  
      return tree;
  
   }

  public Tuple<Brep[], Dictionary<int, List<Guid>>> SortGuidsByPlanarCurves(List<Guid> guids, double tol) {


    var TxtInput = new Dictionary<int, Tuple<Point3d, string>>();
    var crvsInput = new Dictionary<int, Curve>();
    var ptsInput = new Dictionary<int, Point3d>();
    var meshesInput = new Dictionary<int, Mesh>();
    var brepsInput = new Dictionary<int, Brep>();



    //Identify object types
    int id = 0;
    foreach (var g in guids) {

      GeometryBase rhino_obj = Rhino.RhinoDoc.ActiveDoc.Objects.Find(g).Geometry;
      string objectType = rhino_obj.ObjectType.ToString();

      //Rhino.RhinoApp.WriteLine("Uknown type: " + objectType.ToString());

      switch (objectType) {

        case ("Annotation"):
          TextEntity textObj = rhino_obj as TextEntity;
          TxtInput.Add(id, new Tuple<Point3d, string>(textObj.Plane.Origin, textObj.Text));
          break;

        case ("TextDot"):
          TextDot textDotObj = rhino_obj as TextDot;
          TxtInput.Add(id, new Tuple<Point3d, string>(textDotObj.Point, textDotObj.Text));

          break;

        case ("Curve"):
          Curve curve = rhino_obj as Curve;
          //if (curve.IsPolyline()) {
          crvsInput.Add(id, curve);
          //}
          break;

        case ("Point"):
          Rhino.Geometry.Point p = rhino_obj as Rhino.Geometry.Point;
          ptsInput.Add(id, p.Location);
          break;

        case ("Mesh"):
          Mesh m = rhino_obj as Mesh;
          meshesInput.Add(id, m);
          break;

        case ("Brep"):
          Brep b = rhino_obj as Brep;
          brepsInput.Add(id, b);
          break;

        case ("Extrusion"):
          Extrusion e = rhino_obj as Extrusion;
          brepsInput.Add(id, e.ToBrep());
          break;

        default:
          Rhino.RhinoApp.WriteLine("Uknown type: " + objectType.ToString());
          break;


      }

      id++;
    }

    //Joints Curves
    var crvClosed = new List<Curve>();



    foreach (var c in crvsInput) {
      c.Value.Domain = new Interval(0, 1);
      if (c.Value.IsClosed) {
        // if (c.Value.IsPolyline()) {
        crvClosed.Add(c.Value);
        //}

      }
    }


    //Create planar breps
    Brep[] breps = Brep.CreatePlanarBreps(crvClosed);// Rhino.RhinoDoc.ActiveDoc.ModelAbsoluteTolerance);

    HashSet<int> hash = new HashSet<int>();
    Dictionary<int,List<Guid>> guidsTree = new Dictionary<int, List<Guid>>();
    for(int i = 0; i < breps.Length; i++) {
      guidsTree.Add(i, new List<Guid>());
    }

    //Check input

    //Crvs
    for (int i = 0; i < breps.Length; i++) {

      int j = 0;
      foreach (var c in crvsInput) {
        if (!hash.Contains(j)) {

          Point3d p = c.Value.PointAt(0.5);
          double dist = breps[i].ClosestPoint(p).DistanceTo(p);
          if (dist < tol) {
            hash.Add(j);
            guidsTree[i].Add(guids[c.Key]);
          }
        }
        j++;
      }//foreach
    }//for

    hash.Clear();


    //Txt
    for (int i = 0; i < breps.Length; i++) {

      int j = 0;
      foreach (var c in TxtInput) {
        if (!hash.Contains(j)) {

          Point3d p = c.Value.Item1;
          double dist = breps[i].ClosestPoint(p).DistanceTo(p);
          if (dist < tol) {
            hash.Add(j);
            guidsTree[i].Add(guids[c.Key]);
          }
        }
        j++;
      }//foreach
    }//for

    hash.Clear();

    //Points
    for (int i = 0; i < breps.Length; i++) {

      int j = 0;
      foreach (var c in ptsInput) {
        if (!hash.Contains(j)) {

          Point3d p = c.Value;
          double dist = breps[i].ClosestPoint(p).DistanceTo(p);
          if (dist < tol) {
            hash.Add(j);
            guidsTree[i].Add(guids[c.Key]);
          }
        }
        j++;
      }//foreach
    }//for

    hash.Clear();

    //Meshes
    for (int i = 0; i < breps.Length; i++) {

      int j = 0;
      foreach (var c in meshesInput) {
        if (!hash.Contains(j)) {

          Point3d p = c.Value.GetBoundingBox(true).PointAt(0.5, 0.5, 0);
          double dist = breps[i].ClosestPoint(p).DistanceTo(p);
          if (dist < tol) {
            hash.Add(j);
            guidsTree[i].Add(guids[c.Key]);
          }
        }
        j++;
      }//foreach
    }//for

    hash.Clear();

    //Breps
    for (int i = 0; i < breps.Length; i++) {

      int j = 0;
      foreach (var c in brepsInput) {
        if (!hash.Contains(j)) {

          Point3d p = c.Value.GetBoundingBox(true).PointAt(0.5, 0.5, 0);
          double dist = breps[i].ClosestPoint(p).DistanceTo(p);
          if (dist < tol) {
            hash.Add(j);
            guidsTree[i].Add(guids[c.Key]);
          }
        }
        j++;
      }//foreach
    }//for

    hash.Clear();

    return new Tuple<Brep[], Dictionary<int, List<Guid>>>(breps, guidsTree);

  }
# ---------- end c_script ----------
edges_2 = BrepEdges(Brep=c_script.A)  # -> Naked, Interior, NonManifold; disabled
join_2 = JoinCurves(Curves=edges_2.Naked, Preserve=False)  # disabled
len_2 = Length(Curve=join_2)  # disabled
sort = SortList(Keys=len_2, ValuesA=join_2)  # -> reverse(Keys), reverse(ValuesA); disabled
item = ListItem(List=sort.ValuesA, Index=0, Wrap=True)  # disabled
number_slider_34 = Slider(0.392, range=0..1)  # disabled
number_slider_35 = Slider(3.2, range=0..7)  # disabled
topoly = CurveToPolyline(Curve=item, ToleranceDistance=number_slider_34, ToleranceAngle=0)  # -> Polyline, Segments; disabled
number_slider_36 = Slider(6, range=0..10)  # disabled
pcol = PolylineCollapse(Polyline=topoly.Polyline, Tolerance=number_slider_35)  # -> Polyline, Count; disabled
number_slider_37 = Slider(1, range=0..320)  # disabled
boundary_3 = BoundarySurfaces(Edges=pcol.Polyline)  # -> flatten(Surfaces); disabled
number_slider_38 = Slider(1000, range=0..1000)  # disabled
number_slider_39 = Slider(1, range=0..100)  # disabled
button_4 = Button()  # disabled
number_slider_40 = Slider(0, range=-1..0)  # disabled
split = SplitList(List=boundary_3, Index=number_slider_36)  # -> ListA, ListB; disabled
number_slider_41 = Slider(0, range=-1..0)  # disabled
toggle_6 = BooleanToggle(False)  # disabled
crv_25 = Curve(<curve referenced from the Rhino model>)  # disabled
opennest_10 = OpenNest(
    Sheets=crv_25,
    Geo=boundary_3,
    Spacing=1,
    Placement=number_slider_39,
    Tolerance=0.1,
    Rotations=number_slider_38,
    Iterations=number_slider_40,
    Seed=number_slider_41,
    Reset=button_4,
    Run=toggle_6)  # -> Sheets, Geo, ID, Transform, IDS; disabled
button_5 = Button()  # disabled
tguid_3 = TransformGuid(Guid=c_script.B, Transform=simplify(graft(opennest_10.Transform)), Run=button_5)  # disabled

# ----
# Nesting Too Small Objects that are curved
geo_4 = Geometry(flatten([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]))
join_3 = JoinCurves(Curves=geo_4, Preserve=False)  # -> flatten(Curves)
item_2 = ListItem(List=join_3, Index=0, Wrap=True)  # -> Item1, Item
index = ItemIndex(List=join_3, Item=item_2.Item1)
cull_i = CullIndex(List=join_3, Indices=index, Wrap=True)
cp_2 = ControlPoints(Curve=cull_i)  # -> Points, Weights, Knots
crv_26 = Curve(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)
pline_2 = PolyLine(Vertices=cp_2.Points, Closed=invert(False))  # -> flatten(Polyline)
redpline = Reduce(Polyline=pline_2, Tolerance=Slider(0.01, range=0..0.01))  # -> Polyline, Reduction
repeat_5 = RepeatData(Data=crv_26, Length=Slider(10, range=0..10))
area_5 = Area(Geometry=repeat_5)  # -> Area, Centroid
pack_5 = PackObjects(Geo=repeat_5, Plane=area_5.Centroid, X=Slider(1, range=0..10), Y=1, Tolerabce=0)  # -> Geo, Transformation
opennest_11 = OpenNest(
    Sheets=pack_5.Geo,
    Geo=redpline.Polyline,
    Spacing=Slider(0.015, range=0..0.1),
    Placement=1,
    Tolerance=Slider(0.001, range=0..0.001),
    Rotations=4,
    Iterations=Slider(1, range=1..10),
    Seed=1,
    Reset=True,
    Run=False)  # -> Sheets, Geo, ID, Transform, IDS
crv_27 = Curve(opennest_11.Sheets)
transform_6 = Transform(Geometry=cull_i, Transform=opennest_11.Transform)
