# Grasshopper definition OpenNest_Rhino_Objects_Nesting.gh (Grasshopper 1.0.7)
# plug-ins: OpenNest

id = Guid([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])
rhinoobjects = RhinoObjects(GeometryAsGuid=id, T=0.01)  # -> Breps, GeometryAsGuid
crv = Curve(rhinoobjects.Breps)
crv_2 = Curve(<curve referenced from the Rhino model>)
number_slider = Slider(10, range=0..10)
redpline = Reduce(Polyline=crv, Tolerance=Slider(0, range=0..100))  # -> Polyline, Reduction
opennest = OpenNest(
    Sheets=crv_2,
    Geo=redpline.Polyline,
    Spacing=Slider(10, range=0..10),
    Placement=1,
    Tolerance=0.1,
    Rotations=Slider(360, range=0..1000),
    Iterations=Slider(20, range=0..100),
    Seed=1,
    Reset=True,
    Run=False)  # -> Sheets, Geo, ID, Transform, IDS; disabled
tguid = TransformGuid(Guid=rhinoobjects.GeometryAsGuid, Transform=graft(opennest.Transform), Run=Button())
