# Grasshopper definition OpenNest_Rhino_Objects_Pack_Objects.gh (Grasshopper 1.0.7)
# plug-ins: OpenNest

# ---- group: Rhino Objects
id = Guid([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])

id_2 = Guid([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])

# ----
rhinoobjects = RhinoObjects(GeometryAsGuid=id, T=0.01)  # -> Breps, GeometryAsGuid
lng = ListLength(List=rhinoobjects.Breps)
area = Area(Geometry=rhinoobjects.Breps)  # -> Area, Centroid
series = Series(Start=0, Step=1, Count=lng)
sort = SortList(Keys=area.Area, ValuesB=series, ValuesA=rhinoobjects.Breps)  # -> Keys, reverse(ValuesB), reverse(ValuesA)

# ---- group: Distance Between rows
number_slider = Slider(124, range=0..3500)
number_slider_2 = Slider(1038, range=0..3500)

# ---- group: Elements in a row
number_slider_3 = Slider(12, range=0..100)

# ----
geo = Geometry(sort.ValuesA)
area_2 = Area(Geometry=geo)  # -> Area, Centroid
branch = TreeBranch(Tree=rhinoobjects.GeometryAsGuid, Path=sort.ValuesB, MaintainPaths=False)
partition = PartitionList(List=area_2.Centroid, Size=number_slider_3)
partition_2 = PartitionList(List=geo, Size=number_slider_3)
pack = PackObjects(Geo=partition_2, Plane=partition, X=number_slider, Y=number_slider_2, Tolerabce=Slider(0.001, range=0..0.001))  # -> Geo, flatten(Transformation)

# ---- group: Execute
button = Button()

# ---- group: Click here to add objects to rhino
button_2 = Button()

# ----
geo_2 = Geometry(id_2)
demesh = DeconstructMesh(Mesh=geo_2)  # -> Vertices, Faces, Colours, Normals
pca = PCAComponent(P=demesh.Vertices)  # -> Box, Mesh, Line, Plane, Plane_2
orient = Orient(Geometry=simplify(graft(geo_2)), Source=simplify(pca.Plane), Target=simplify(PlaneXY(0, 0, 0)))  # -> flatten(Geometry), Transform
number_slider_4 = Slider(12, range=0..100)
lng_2 = ListLength(List=orient.Geometry)
xy = XYPlane(Origin=Point(0, 0, 0))
repeat = RepeatData(Data=xy, Length=lng_2)
partition_3 = PartitionList(List=orient.Geometry, Size=number_slider_4)
partition_4 = PartitionList(List=repeat, Size=number_slider_4)
pack_2 = PackObjects(Geo=partition_3, Plane=partition_4, X=1, Y=Slider(87, range=0..100), Tolerabce=Slider(0.01, range=0..0.01))  # -> Geo, flatten(Transformation)
tguid = TransformGuid(Guid=id_2, Transform=pack_2.Transformation, Run=button_2)

tguid_2 = TransformGuid(Guid=branch, Transform=graft(pack.Transformation), Run=button)
