# Grasshopper definition OpenNest_Rhino_Objects_Pack_Objects_By_Size.gh (Grasshopper 1.0.7)
# plug-ins: OpenNest

# ---- group: Rhino Objects
id = Guid([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])

# ---- group: Insert Rhino Geometry
id_2 = Guid([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])

# ---- group: Click here
button = Button()

# ----
number_slider = Slider(12, range=0..100)
geo = Geometry(id_2)
area = Area(Geometry=geo)  # -> Area, Centroid
partition = PartitionList(List=area.Centroid, Size=number_slider)
partition_2 = PartitionList(List=id_2, Size=number_slider)
pack = PackObjects(Geo=partition_2, Plane=partition, X=1, Y=Slider(77, range=0..100), Tolerabce=0)  # -> Geo, flatten(Transformation)
tguid = TransformGuid(Guid=id_2, Transform=pack.Transformation, Run=button)

# ---- group: Click here to add objects to rhino
button_2 = Button()

# ----
geo_2 = Geometry(id)
demesh = DeconstructMesh(Mesh=geo_2)  # -> Vertices, Faces, Colours, Normals
pca = PCAComponent(P=demesh.Vertices)  # -> Box, Mesh, Line, Plane, Plane_2
orient = Orient(Geometry=simplify(graft(geo_2)), Source=simplify(pca.Plane), Target=simplify(PlaneXY(0, 0, 0)))  # -> flatten(Geometry), Transform
number_slider_2 = Slider(12, range=0..100)
lng = ListLength(List=orient.Geometry)
xy = XYPlane(Origin=Point(0, 0, 0))
repeat = RepeatData(Data=xy, Length=lng)
partition_3 = PartitionList(List=orient.Geometry, Size=number_slider_2)
partition_4 = PartitionList(List=repeat, Size=number_slider_2)
pack_2 = PackObjects(Geo=partition_3, Plane=partition_4, X=1, Y=Slider(87, range=0..100), Tolerabce=Slider(0.01, range=0..0.01))  # -> Geo, flatten(Transformation)
tguid_2 = TransformGuid(Guid=id, Transform=pack_2.Transformation, Run=button_2)
