# Grasshopper definition trial-gh-graph_mapping.gh (Grasshopper 1.0.7)

domain = Domain(Domain(0, 10))
range = Range(Domain=domain, Steps=10)
num = Number(range)
graph = GraphMapper(num)
graph_2 = GraphMapper(num, x0=0, x1=10, y0=0, y1=10, Cx=0.7579575777, Cy=0.317553997, container_name="Conic")
graph_3 = GraphMapper(num, x0=0, x1=10, y0=0, y1=10, container_name="Gaussian", factor=0.1861585379, mean=0.6566675305, sdev=0.1330044568)
graph_4 = GraphMapper(
    num,
    x0=0,
    x1=10,
    y0=0,
    y1=10,
    A=0.1793111394,
    B=0.4438246402,
    container_name="Linear",
    Graph_x0=0.07282821089,
    Graph_x1=0.965944171,
    Graph_y0=0.4568835497,
    Graph_y1=0.6170291901)
graph_5 = GraphMapper(
    num,
    x0=0,
    x1=10,
    y0=0,
    y1=10,
    Ox=0.1344224066,
    Oy=0.6793478131,
    Px=0.5902187824,
    Py=0.3467389345,
    container_name="Parabola")
graph_6 = GraphMapper(
    num,
    x0=0,
    x1=10,
    y0=0,
    y1=10,
    amplitude=0.6430734992,
    container_name="Perlin",
    decay=0.7870819569,
    frequency=0.3271555156,
    x_offset=0.4930897653,
    y_offset=0.3569265008)
graph_7 = GraphMapper(num, x0=0, x1=10, y0=0, y1=10, Gx=0.6932992339, Gy=0.3324098587, container_name="Power", power=3.006841024)
graph_8 = GraphMapper(
    num,
    x0=0,
    x1=10,
    y0=0,
    y1=10,
    container_name="Sinc",
    Equation_X0=0.381786406,
    Equation_X1=0.6443472505,
    Equation_Y0=0.5257480145,
    Equation_Y1=0.3121390939)
graph_9 = GraphMapper(
    num,
    x0=0,
    x1=10,
    y0=0,
    y1=10,
    container_name="Sine",
    Equation_px=[0.3221559525, 0.4167232811],
    Equation_py=[0.5842957497, 0.1606392264])
graph_10 = GraphMapper(
    num,
    x0=0,
    x1=10,
    y0=0,
    y1=10,
    Gx=0.5330934525,
    Gy=0.5560302734,
    Ox=0.3639853597,
    Oy=0.3958227038,
    container_name="Square Root")
graph_11 = GraphMapper(
    num,
    x0=0,
    x1=10,
    y0=0,
    y1=10,
    container_name="Sine Summation",
    Equation0_px=[0.5502681732, 0.3944887817],
    Equation0_py=[0.5049429536, 0.3054376245],
    Equation1_px=[0.2551057339, 0.8618234992],
    Equation1_py=[0.4967448115, 0.2671747804])
graph_12 = GraphMapper(
    num,
    x0=0,
    x1=10,
    y0=0,
    y1=10,
    container_name="Bezier",
    cpx=[0, 0.7684273124, 0.4909455776, 1],
    cpy=[0.431720674, 0.4264851213, 0.2746555209, 0.07570612431])
num_2 = Number(graph)
num_3 = Number(graph_2)
num_4 = Number(graph_12)
num_5 = Number(graph_4)
num_6 = Number(graph_3)
num_7 = Number(graph_6)
num_8 = Number(graph_5)
num_9 = Number(graph_8)
num_10 = Number(graph_7)
num_11 = Number(graph_11)
num_12 = Number(graph_9)
num_13 = Number(graph_10)
pt = ConstructPoint(XCoordinate=num_2, YCoordinate=num_2, ZCoordinate=0)
pt_2 = ConstructPoint(XCoordinate=num_3, YCoordinate=num_3, ZCoordinate=0)
pt_3 = ConstructPoint(XCoordinate=num_4, YCoordinate=num_4, ZCoordinate=0)
pt_4 = ConstructPoint(XCoordinate=num_6, YCoordinate=num_6, ZCoordinate=0)
pt_5 = ConstructPoint(XCoordinate=num_5, YCoordinate=num_5, ZCoordinate=0)
pt_6 = ConstructPoint(XCoordinate=num_7, YCoordinate=num_7, ZCoordinate=0)
pt_7 = ConstructPoint(XCoordinate=num_8, YCoordinate=num_8, ZCoordinate=0)
pt_8 = ConstructPoint(XCoordinate=num_10, YCoordinate=num_10, ZCoordinate=0)
pt_9 = ConstructPoint(XCoordinate=num_9, YCoordinate=num_9, ZCoordinate=0)
pt_10 = ConstructPoint(XCoordinate=num_11, YCoordinate=num_11, ZCoordinate=0)
pt_11 = ConstructPoint(XCoordinate=num_12, YCoordinate=num_12, ZCoordinate=0)
pt_12 = ConstructPoint(XCoordinate=num_13, YCoordinate=num_13, ZCoordinate=0)
pt_13 = Point(pt)
pt_14 = Point(pt_2)
pt_15 = Point(pt_3)
pt_16 = Point(pt_5)
pt_17 = Point(pt_4)
pt_18 = Point(pt_6)
pt_19 = Point(pt_7)
pt_20 = Point(pt_9)
pt_21 = Point(pt_8)
pt_22 = Point(pt_10)
pt_23 = Point(pt_11)
pt_24 = Point(pt_12)
domain_2 = Domain(Domain(0, 10))
random = Random(Range=domain_2, Number=Slider(10, range=0..10), Seed=2)
num_14 = Number(random)
graph_13 = GraphMapper(num_14)
graph_14 = GraphMapper(num_14, x0=0, x1=10, y0=0, y1=10, Cx=0.4336999059, Cy=0.5253623128, container_name="Conic")
graph_15 = GraphMapper(num_14, x0=0, x1=10, y0=0, y1=10, container_name="Gaussian", factor=0.3550724387, mean=0.4927536249, sdev=0.1594202816)
graph_16 = GraphMapper(
    num_14,
    x0=0,
    x1=10,
    y0=0,
    y1=10,
    A=-0.5903633941,
    B=0.618960691,
    container_name="Linear",
    Graph_x0=0.717030406,
    Graph_x1=0.2057999372,
    Graph_y0=0.1956521869,
    Graph_y1=0.4974639416)
graph_17 = GraphMapper(
    num_14,
    x0=0,
    x1=10,
    y0=0,
    y1=10,
    Ox=0.1344224066,
    Oy=0.6793478131,
    Px=0.5899286866,
    Py=0.4462925792,
    container_name="Parabola")
graph_18 = GraphMapper(
    num_14,
    x0=0,
    x1=10,
    y0=0,
    y1=10,
    amplitude=0.6430734992,
    container_name="Perlin",
    decay=0.9379829764,
    frequency=0.3271555156,
    x_offset=0.4930897653,
    y_offset=0.3569265008)
graph_19 = GraphMapper(num_14, x0=0, x1=10, y0=0, y1=10, Gx=0.6932992339, Gy=0.3324098587, container_name="Power", power=3.006841024)
graph_20 = GraphMapper(
    num_14,
    x0=0,
    x1=10,
    y0=0,
    y1=10,
    container_name="Sinc",
    Equation_X0=0.381786406,
    Equation_X1=0.6443472505,
    Equation_Y0=0.5257480145,
    Equation_Y1=0.3121390939)
graph_21 = GraphMapper(
    num_14,
    x0=0,
    x1=10,
    y0=0,
    y1=10,
    container_name="Sine",
    Equation_px=[0.3221559525, 0.4167232811],
    Equation_py=[0.5842957497, 0.1606392264])
graph_22 = GraphMapper(
    num_14,
    x0=0,
    x1=10,
    y0=0,
    y1=10,
    Gx=0.5330934525,
    Gy=0.5560302734,
    Ox=0.3639853597,
    Oy=0.3958227038,
    container_name="Square Root")
graph_23 = GraphMapper(
    num_14,
    x0=0,
    x1=10,
    y0=0,
    y1=10,
    container_name="Sine Summation",
    Equation0_px=[0.5502681732, 0.3944887817],
    Equation0_py=[0.5049429536, 0.3054376245],
    Equation1_px=[0.2551057339, 0.8618234992],
    Equation1_py=[0.4967448115, 0.2671747804])
graph_24 = GraphMapper(
    num_14,
    x0=0,
    x1=10,
    y0=0,
    y1=10,
    container_name="Bezier",
    cpx=[0, 0.5862346888, 1, 1],
    cpy=[0.1565215588, 0.7047101259, 0.5199275017, 0.07570612431])
num_15 = Number(graph_13)
num_16 = Number(graph_14)
num_17 = Number(graph_24)
num_18 = Number(graph_16)
num_19 = Number(graph_15)
num_20 = Number(graph_18)
num_21 = Number(graph_17)
num_22 = Number(graph_20)
num_23 = Number(graph_19)
num_24 = Number(graph_23)
num_25 = Number(graph_21)
num_26 = Number(graph_22)
pt_25 = ConstructPoint(XCoordinate=num_15, YCoordinate=num_15, ZCoordinate=0)
pt_26 = ConstructPoint(XCoordinate=num_16, YCoordinate=num_16, ZCoordinate=0)
pt_27 = ConstructPoint(XCoordinate=num_17, YCoordinate=num_17, ZCoordinate=0)
pt_28 = ConstructPoint(XCoordinate=num_19, YCoordinate=num_19, ZCoordinate=0)
pt_29 = ConstructPoint(XCoordinate=num_18, YCoordinate=num_18, ZCoordinate=0)
pt_30 = ConstructPoint(XCoordinate=num_20, YCoordinate=num_20, ZCoordinate=0)
pt_31 = ConstructPoint(XCoordinate=num_21, YCoordinate=num_21, ZCoordinate=0)
pt_32 = ConstructPoint(XCoordinate=num_23, YCoordinate=num_23, ZCoordinate=0)
pt_33 = ConstructPoint(XCoordinate=num_22, YCoordinate=num_22, ZCoordinate=0)
pt_34 = ConstructPoint(XCoordinate=num_24, YCoordinate=num_24, ZCoordinate=0)
pt_35 = ConstructPoint(XCoordinate=num_25, YCoordinate=num_25, ZCoordinate=0)
pt_36 = ConstructPoint(XCoordinate=num_26, YCoordinate=num_26, ZCoordinate=0)
pt_37 = Point(pt_25)
pt_38 = Point(pt_26)
pt_39 = Point(pt_27)
pt_40 = Point(pt_29)
pt_41 = Point(pt_28)
pt_42 = Point(pt_30)
pt_43 = Point(pt_31)
pt_44 = Point(pt_33)
pt_45 = Point(pt_32)
pt_46 = Point(pt_34)
pt_47 = Point(pt_35)
pt_48 = Point(pt_36)
number_slider = Slider(24, range=0..100)
pt_49 = Point(Point(0, 0, 0))
hex_grid_generator = HexGridGenerator(origin_point=pt_49, cell_scale=Slider(1.11, range=0..10), x_axis_extent=number_slider, y_axis_extent=number_slider)  # -> flatten(grid_cell_curves_2), flatten(grid_area_centroids)
pt_50 = Point(hex_grid_generator.grid_area_centroids)
crv = Curve(hex_grid_generator.grid_cell_curves_2)
bbox = BoundingBox(Content=crv, Plane=PlaneXY(0, 0, 0), UnionBox=True)  # -> Box, Box_2
area = Area(Geometry=bbox.Box_2)  # -> Area, Centroid
num_27 = Number(Slider(0.88, range=0..1))
num_28 = Number(Slider(0.22, range=0..1))
point_attractor = PointAttractor(A_2=area.Centroid, B_2=pt_50, A=num_27, B=num_28)
num_29 = Number(point_attractor)
graph_25 = GraphMapper(
    num_29,
    x0=0,
    x1=1,
    y0=0,
    y1=1,
    container_name="Sinc",
    Equation_X0=0.3833786249,
    Equation_X1=0.57028687,
    Equation_Y0=0.3376305699,
    Equation_Y1=0.6580438614)
graph_26 = GraphMapper(
    num_29,
    x0=0,
    x1=1,
    y0=0,
    y1=1,
    container_name="Sine",
    Equation_px=[0.1108699217, 0.4188409448],
    Equation_py=[0.4717380404, 0.06521737576])
graph_27 = GraphMapper(
    num_29,
    x0=0,
    x1=1,
    y0=0,
    y1=1,
    Gx=0.3746311367,
    Gy=0.2460088134,
    Ox=0.5140132904,
    Oy=0.5056400299,
    container_name="Square Root")
graph_28 = GraphMapper(num_29, x0=0, x1=1, y0=0, y1=1)
graph_29 = GraphMapper(
    num_29,
    x0=0,
    x1=1,
    y0=0,
    y1=1,
    container_name="Bezier",
    cpx=[0, 0.2402175665, 0.07391357422, 1],
    cpy=[0, 1, 0.3134058118, 1])
graph_30 = GraphMapper(num_29, x0=0, x1=1, y0=0, y1=1, Cx=0.4619565308, Cy=0.6076085567, container_name="Conic")
graph_31 = GraphMapper(num_29, x0=0, x1=1, y0=0, y1=1, container_name="Gaussian", factor=0.1888759732, mean=0.6082436442, sdev=0.1047098041)
graph_32 = GraphMapper(
    num_29,
    x0=0,
    x1=1,
    y0=0,
    y1=1,
    A=3.000000968,
    B=-0.9047113001,
    container_name="Linear",
    Graph_x0=0.4865943789,
    Graph_x1=0.4250001907,
    Graph_y0=0.5550723076,
    Graph_y1=0.3702896833)
graph_33 = GraphMapper(
    num_29,
    x0=0,
    x1=1,
    y0=0,
    y1=1,
    Ox=0.2627006173,
    Oy=0.1551257372,
    Px=0.6291857958,
    Py=0.5949078798,
    container_name="Parabola")
graph_34 = GraphMapper(
    num_29,
    x0=0,
    x1=1,
    y0=0,
    y1=1,
    amplitude=0.2402175665,
    container_name="Perlin",
    decay=0.9003623128,
    frequency=0.02971082926,
    x_offset=0.5,
    y_offset=0.5)
graph_35 = GraphMapper(num_29, x0=0, x1=1, y0=0, y1=1, Gx=0.371586442, Gy=0.5445857048, container_name="Power", power=0.6138849066)
graph_36 = GraphMapper(
    num_29,
    x0=0,
    x1=1,
    y0=0,
    y1=1,
    container_name="Sine Summation",
    Equation0_px=[0.497826606, 0.4188409448],
    Equation0_py=[0.1101445556, 0.4036228061],
    Equation1_px=[0.2710146606, 0.8119568825],
    Equation1_py=[0.4898540378, 0.1963757277])
scale = Scale(Geometry=crv, Center=pt_50, Factor=graph_28)  # -> Geometry, Transform
scale_2 = Scale(Geometry=crv, Center=pt_50, Factor=graph_29)  # -> Geometry, Transform
scale_3 = Scale(Geometry=crv, Center=pt_50, Factor=graph_30)  # -> Geometry, Transform
scale_4 = Scale(Geometry=crv, Center=pt_50, Factor=graph_31)  # -> Geometry, Transform
scale_5 = Scale(Geometry=crv, Center=pt_50, Factor=graph_32)  # -> Geometry, Transform
scale_6 = Scale(Geometry=crv, Center=pt_50, Factor=graph_33)  # -> Geometry, Transform
scale_7 = Scale(Geometry=crv, Center=pt_50, Factor=graph_34)  # -> Geometry, Transform
scale_8 = Scale(Geometry=crv, Center=pt_50, Factor=graph_35)  # -> Geometry, Transform
scale_9 = Scale(Geometry=crv, Center=pt_50, Factor=graph_25)  # -> Geometry, Transform
scale_10 = Scale(Geometry=crv, Center=pt_50, Factor=graph_26)  # -> Geometry, Transform
scale_11 = Scale(Geometry=crv, Center=pt_50, Factor=graph_36)  # -> Geometry, Transform
scale_12 = Scale(Geometry=crv, Center=pt_50, Factor=graph_27)  # -> Geometry, Transform
crv_2 = Curve(scale_2.Geometry)
crv_3 = Curve(scale_3.Geometry)
crv_4 = Curve(scale_4.Geometry)
crv_5 = Curve(scale_5.Geometry)
crv_6 = Curve(scale_6.Geometry)
crv_7 = Curve(scale_7.Geometry)
crv_8 = Curve(scale_8.Geometry)
crv_9 = Curve(scale_9.Geometry)
crv_10 = Curve(scale_10.Geometry)
crv_11 = Curve(scale_11.Geometry)
crv_12 = Curve(scale_12.Geometry)
crv_13 = Curve(scale.Geometry)
number_slider_2 = Slider(24, range=0..100)
pt_51 = Point(Point(0, 0, 0))
hex_grid_generator_2 = HexGridGenerator(origin_point=pt_51, cell_scale=Slider(1.11, range=0..10), x_axis_extent=number_slider_2, y_axis_extent=number_slider_2)  # -> flatten(grid_cell_curves_2), flatten(grid_area_centroids)
pt_52 = Point(hex_grid_generator_2.grid_area_centroids)
crv_14 = Curve(hex_grid_generator_2.grid_cell_curves_2)
crv_15 = Curve(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)
num_30 = Number(Slider(0.88, range=0..1))
num_31 = Number(Slider(0.22, range=0..1))
curve_attractor = CurveAttractor(C=crv_15, P=pt_52, A=num_30, B=num_31)  # -> R, points_on_curve_2
num_32 = Number(curve_attractor.R)
num_33 = Number(curve_attractor.R)
graph_37 = GraphMapper(num_32)
graph_38 = GraphMapper(
    num_32,
    x0=0,
    x1=1,
    y0=0,
    y1=1,
    container_name="Bezier",
    cpx=[0, 0.7684273124, 0.4909455776, 1],
    cpy=[0.431720674, 0.4264851213, 0.2746555209, 0.07570612431])
graph_39 = GraphMapper(num_32, x0=0, x1=1, y0=0, y1=1, Cx=0.7579575777, Cy=0.317553997, container_name="Conic")
graph_40 = GraphMapper(num_32, x0=0, x1=1, y0=0, y1=1, container_name="Gaussian", factor=0.1861585379, mean=0.6061268449, sdev=0.1330044568)
graph_41 = GraphMapper(
    num_32,
    x0=0,
    x1=1,
    y0=0,
    y1=1,
    A=-0.581081757,
    B=0.9542509317,
    container_name="Linear",
    Graph_x0=0.4724651873,
    Graph_x1=0.9282615781,
    Graph_y0=0.6797100306,
    Graph_y1=0.414855063)
graph_42 = GraphMapper(
    num_32,
    x0=0,
    x1=1,
    y0=0,
    y1=1,
    Ox=0.460144937,
    Oy=0.5634058118,
    Px=0.6928569674,
    Py=0.3730406761,
    container_name="Parabola")
graph_43 = GraphMapper(
    num_32,
    x0=0,
    x1=1,
    y0=0,
    y1=1,
    amplitude=0.2402175665,
    container_name="Perlin",
    decay=0.9003623128,
    frequency=0.02971082926,
    x_offset=0.5,
    y_offset=0.5)
graph_44 = GraphMapper(num_32, x0=0, x1=1, y0=0, y1=1, Gx=0.6932992339, Gy=0.3324098587, container_name="Power", power=3.006841024)
graph_45 = GraphMapper(
    num_32,
    x0=0,
    x1=1,
    y0=0,
    y1=1,
    container_name="Sinc",
    Equation_X0=0.381786406,
    Equation_X1=0.6443472505,
    Equation_Y0=0.5257480145,
    Equation_Y1=0.3121390939)
graph_46 = GraphMapper(
    num_32,
    x0=0,
    x1=1,
    y0=0,
    y1=1,
    container_name="Sine",
    Equation_px=[0.3221559525, 0.4167232811],
    Equation_py=[0.5842957497, 0.1606392264])
graph_47 = GraphMapper(
    num_32,
    x0=0,
    x1=1,
    y0=0,
    y1=1,
    Gx=0.5330934525,
    Gy=0.5560302734,
    Ox=0.3639853597,
    Oy=0.3958227038,
    container_name="Square Root")
graph_48 = GraphMapper(
    num_32,
    x0=0,
    x1=1,
    y0=0,
    y1=1,
    container_name="Sine Summation",
    Equation0_px=[0.5502681732, 0.3944887817],
    Equation0_py=[0.5049429536, 0.3054376245],
    Equation1_px=[0.2551057339, 0.8618234992],
    Equation1_py=[0.4967448115, 0.2671747804])
graph_49 = GraphMapper(num_33)
graph_50 = GraphMapper(
    num_33,
    x0=0,
    x1=1,
    y0=0,
    y1=1,
    container_name="Bezier",
    cpx=[0, 0.7684273124, 0.4909455776, 1],
    cpy=[0.431720674, 0.4264851213, 0.2746555209, 0.07570612431])
graph_51 = GraphMapper(num_33, x0=0, x1=1, y0=0, y1=1, Cx=0.7579575777, Cy=0.317553997, container_name="Conic")
graph_52 = GraphMapper(num_33, x0=0, x1=1, y0=0, y1=1, container_name="Gaussian", factor=0.1861585379, mean=0.6061268449, sdev=0.1330044568)
graph_53 = GraphMapper(
    num_33,
    x0=0,
    x1=1,
    y0=0,
    y1=1,
    A=-0.581081757,
    B=0.9542509317,
    container_name="Linear",
    Graph_x0=0.4724651873,
    Graph_x1=0.9282615781,
    Graph_y0=0.6797100306,
    Graph_y1=0.414855063)
graph_54 = GraphMapper(
    num_33,
    x0=0,
    x1=1,
    y0=0,
    y1=1,
    Ox=0.460144937,
    Oy=0.5634058118,
    Px=0.6928569674,
    Py=0.3730406761,
    container_name="Parabola")
graph_55 = GraphMapper(
    num_33,
    x0=0,
    x1=1,
    y0=0,
    y1=1,
    amplitude=0.2402175665,
    container_name="Perlin",
    decay=0.9003623128,
    frequency=0.02971082926,
    x_offset=0.5,
    y_offset=0.5)
graph_56 = GraphMapper(num_33, x0=0, x1=1, y0=0, y1=1, Gx=0.6932992339, Gy=0.3324098587, container_name="Power", power=3.006841024)
graph_57 = GraphMapper(
    num_33,
    x0=0,
    x1=1,
    y0=0,
    y1=1,
    container_name="Sinc",
    Equation_X0=0.381786406,
    Equation_X1=0.6443472505,
    Equation_Y0=0.5257480145,
    Equation_Y1=0.3121390939)
graph_58 = GraphMapper(
    num_33,
    x0=0,
    x1=1,
    y0=0,
    y1=1,
    container_name="Sine",
    Equation_px=[0.3221559525, 0.4167232811],
    Equation_py=[0.5842957497, 0.1606392264])
graph_59 = GraphMapper(
    num_33,
    x0=0,
    x1=1,
    y0=0,
    y1=1,
    Gx=0.5330934525,
    Gy=0.5560302734,
    Ox=0.3639853597,
    Oy=0.3958227038,
    container_name="Square Root")
graph_60 = GraphMapper(
    num_33,
    x0=0,
    x1=1,
    y0=0,
    y1=1,
    container_name="Sine Summation",
    Equation0_px=[0.5502681732, 0.3944887817],
    Equation0_py=[0.5049429536, 0.3054376245],
    Equation1_px=[0.2551057339, 0.8618234992],
    Equation1_py=[0.4967448115, 0.2671747804])
scale_13 = Scale(Geometry=crv_14, Center=pt_52, Factor=graph_37)  # -> Geometry, Transform
scale_14 = Scale(Geometry=crv_14, Center=pt_52, Factor=graph_38)  # -> Geometry, Transform
scale_15 = Scale(Geometry=crv_14, Center=pt_52, Factor=graph_39)  # -> Geometry, Transform
scale_16 = Scale(Geometry=crv_14, Center=pt_52, Factor=graph_40)  # -> Geometry, Transform
scale_17 = Scale(Geometry=crv_14, Center=pt_52, Factor=graph_41)  # -> Geometry, Transform
scale_18 = Scale(Geometry=crv_14, Center=pt_52, Factor=graph_42)  # -> Geometry, Transform
scale_19 = Scale(Geometry=crv_14, Center=pt_52, Factor=graph_43)  # -> Geometry, Transform
scale_20 = Scale(Geometry=crv_14, Center=pt_52, Factor=graph_44)  # -> Geometry, Transform
scale_21 = Scale(Geometry=crv_14, Center=pt_52, Factor=graph_45)  # -> Geometry, Transform
scale_22 = Scale(Geometry=crv_14, Center=pt_52, Factor=graph_46)  # -> Geometry, Transform
scale_23 = Scale(Geometry=crv_14, Center=pt_52, Factor=graph_48)  # -> Geometry, Transform
scale_24 = Scale(Geometry=crv_14, Center=pt_52, Factor=graph_47)  # -> Geometry, Transform
crv_16 = Curve(scale_14.Geometry)
crv_17 = Curve(scale_15.Geometry)
crv_18 = Curve(scale_16.Geometry)
crv_19 = Curve(scale_17.Geometry)
crv_20 = Curve(scale_18.Geometry)
crv_21 = Curve(scale_19.Geometry)
crv_22 = Curve(scale_20.Geometry)
crv_23 = Curve(scale_21.Geometry)
crv_24 = Curve(scale_22.Geometry)
crv_25 = Curve(scale_23.Geometry)
crv_26 = Curve(scale_24.Geometry)
crv_27 = Curve(scale_13.Geometry)

# ==== cluster HexGridGenerator: Grid Gen
y_axis_extent = ClusterInput()
x_axis_extent = ClusterInput()
in = ClusterInput()  # "---------------------"
origin_point = ClusterInput()
cell_scale = ClusterInput()
y_axis_extent_2 = Number(y_axis_extent)
x_axis_extent_2 = Number(x_axis_extent)
cell_scale_2 = Number(cell_scale)
origin_point_2 = Point(origin_point)
division = Division(XAxisExtent=x_axis_extent_2, B=cell_scale_2)
division_2 = Division(YAxisExtent=y_axis_extent_2, B=cell_scale_2)
hexgrid = Hexagonal(Plane=origin_point_2, Size=cell_scale_2, ExtentX=division, ExtentY=division_2)  # -> Cells, Points
grid_cell_curves = Curve(hexgrid.Cells)
area = Area(Geometry=grid_cell_curves)  # -> Area, GridAreaCentroids
grid_area_centroids = ClusterOutput(area.GridAreaCentroids)
grid_cell_curves_2 = ClusterOutput(grid_cell_curves)

# ==== cluster PointAttractor: Utility
A = ClusterInput()
x = ClusterInput()
A_2 = ClusterInput()
B = ClusterInput()
B_2 = ClusterInput()
dist = Distance(PointA=A_2, PointB=B_2)
dom = ConstructDomain(DomainStart=A, DomainEnd=B)
bnd = Bounds(Numbers=dist)
remap = RemapNumbers(Value=dist, Source=bnd, Target=dom)  # -> Mapped, Clipped
R = ClusterOutput(remap.Mapped)

# ==== cluster CurveAttractor: Utility
C = ClusterInput()
P = ClusterInput()
x = ClusterInput()
A = ClusterInput()
B = ClusterInput()
crv_cp = CurveClosestPoint(Point=P, Curve=C)  # -> Point, Parameter, Distance
dom = ConstructDomain(DomainStart=A, DomainEnd=B)
bnd = Bounds(Numbers=crv_cp.Distance)
remap = RemapNumbers(Value=crv_cp.Distance, Source=bnd, Target=dom)  # -> Mapped, Clipped
R = ClusterOutput(remap.Mapped)
points_on_curve = Point(crv_cp.Point)
points_on_curve_2 = ClusterOutput(points_on_curve)
