# Grasshopper definition trial-gh-nurbs_curve.gh (Grasshopper 1.0.7)

number_slider = Slider(24, range=0..100)
pt = Point(Point(0, 0, 0))
pt_2 = Point(pt)
num = Number(number_slider)
num_2 = Number(Slider(1.11, range=0..10))
num_3 = Number(number_slider)
hex_grid_generator = HexGridGenerator(origin_point=pt_2, cell_scale=num_2, x_axis_extent=num, y_axis_extent=num_3)  # -> grid_cell_curves_2, grid_area_centroids
crv = Curve(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)
crv_2 = Curve(flatten(hex_grid_generator.grid_cell_curves_2))
pt_3 = Point(flatten(hex_grid_generator.grid_area_centroids))
crv_3 = Curve(flatten(hex_grid_generator.grid_cell_curves_2))
num_4 = Number(Slider(0.777, range=0..1))
num_5 = Number(Slider(0.222, range=0..1))
crv_4 = Curve(crv)
curve_attractor = CurveAttractor(C=crv_4, P=pt_3, A=num_4, B=num_5)  # -> R, points_on_curve_2
crv_5 = Curve(crv_2)
scale = Scale(Geometry=crv_2, Center=pt_3, Factor=curve_attractor.R)  # -> Geometry, Transform
crv_6 = Curve(scale.Geometry)
disc = Discontinuity(Curve=crv_5, Level=1)  # -> Points, Parameters
explode = Explode(Curve=crv_5, Recursive=True)  # -> Segments, Vertices
disc_2 = Discontinuity(Curve=crv_6, Level=1)  # -> Points, Parameters
explode_2 = Explode(Curve=crv_6, Recursive=True)  # -> Segments, Vertices
midpt = CurveMiddle(Curve=explode.Segments)
midpt_2 = CurveMiddle(Curve=explode_2.Segments)
item = ListItem(List=midpt, Index=0, Wrap=True)  # -> Item, Item1, Item2, Item3, Item4, Item5
item_2 = ListItem(List=midpt_2, Index=0, Wrap=True)  # -> Item, Item1, Item2, Item3, Item4, Item5
item_3 = ListItem(List=disc.Points, Index=0, Wrap=True)  # -> Item, Item1, Item2, Item3, Item4, Item5
item_4 = ListItem(List=disc_2.Points, Index=0, Wrap=True)  # -> Item, Item1, Item2, Item3, Item4, Item5
pt_4 = Point(item.Item1)
pt_5 = Point(item.Item)
pt_6 = Point(item.Item2)
pt_7 = Point(item.Item3)
pt_8 = Point(item.Item4)
pt_9 = Point(item.Item5)
pt_10 = Point(item_2.Item)
pt_11 = Point(item_2.Item1)
pt_12 = Point(item_2.Item2)
pt_13 = Point(item_2.Item4)
pt_14 = Point(item_2.Item3)
pt_15 = Point(item_2.Item5)
pt_16 = Point(item_4.Item2)
pt_17 = Point(item_4.Item1)
pt_18 = Point(item_4.Item3)
pt_19 = Point(item_4.Item4)
pt_20 = Point(item_3.Item1)
pt_21 = Point(item_4.Item)
pt_22 = Point(item_4.Item5)
pt_23 = Point(item_3.Item)
pt_24 = Point(item_3.Item2)
pt_25 = Point(item_3.Item3)
pt_26 = Point(item_3.Item4)
pt_27 = Point(item_3.Item5)
num_6 = Number(Slider(1.85, range=0..10))
num_7 = Number(Slider(0.13, range=0..10))
crv_7 = Curve(crv)
curve_attractor_2 = CurveAttractor(C=crv_7, P=pt_16, A=num_6, B=num_7)  # -> R, points_on_curve_2
Z = UnitZ(Factor=curve_attractor_2.R)
move = Move(Geometry=pt_16, Motion=Z)  # -> Geometry, Transform

# ==== cluster HexGridGenerator: Grid Gen
y_axis_extent = ClusterInput()
x_axis_extent = ClusterInput()
in = ClusterInput()  # "---------------------"
origin_point = ClusterInput()
cell_scale = ClusterInput()
y_axis_extent_2 = Number(y_axis_extent)
x_axis_extent_2 = Number(x_axis_extent)
cell_scale_2 = Number(cell_scale)
origin_point_2 = Point(origin_point)
division = Division(XAxisExtent=x_axis_extent_2, B=cell_scale_2)
division_2 = Division(YAxisExtent=y_axis_extent_2, B=cell_scale_2)
hexgrid = Hexagonal(Plane=origin_point_2, Size=cell_scale_2, ExtentX=division, ExtentY=division_2)  # -> Cells, Points
grid_cell_curves = Curve(hexgrid.Cells)
area = Area(Geometry=grid_cell_curves)  # -> Area, GridAreaCentroids
grid_area_centroids = ClusterOutput(area.GridAreaCentroids)
grid_cell_curves_2 = ClusterOutput(grid_cell_curves)

# ==== cluster CurveAttractor: Utility
C = ClusterInput()
P = ClusterInput()
x = ClusterInput()
A = ClusterInput()
B = ClusterInput()
crv_cp = CurveClosestPoint(Point=P, Curve=C)  # -> Point, Parameter, Distance
dom = ConstructDomain(DomainStart=A, DomainEnd=B)
bnd = Bounds(Numbers=crv_cp.Distance)
remap = RemapNumbers(Value=crv_cp.Distance, Source=bnd, Target=dom)  # -> Mapped, Clipped
R = ClusterOutput(remap.Mapped)
points_on_curve = Point(crv_cp.Point)
points_on_curve_2 = ClusterOutput(points_on_curve)
