# Grasshopper definition trial-ghpython-library.gh (Grasshopper 1.0.7)

number_slider = Slider(36, range=0..100)
pt = Point(Point(0, 0, 0))
cell_creator = GhPythonScript(Index=Slider(1, range=0..10), X=number_slider, Y=number_slider, Size=Slider(1.87, range=0..10), Origin=pt)  # -> Cells, Edges, Centers, Info; inputs Index: Int32, X: Int32, Y: Int32, Origin: Point3d
# ---------- cell_creator: Python ----------
__author__ = "FHarker"
__version__ = "2025.10.01"

"""Pattern Library Browser (Slider-driven)
Inputs:
    Pattern: optional text name: "square", "tri", "hex", "weave", "cairo"
    Index: integer index (0-based) to select pattern
    X: int, cells in X
    Y: int, cells in Y
    Size: float, base module size
    Origin: Point3d, base origin
Outputs:
    Cells: list[Polyline], closed cell boundaries
    Edges: list[Line], unique edges (undirected)
    Centers: list[Point3d], cell centroids
    Info: string summary
"""

import Rhino
from Rhino.Geometry import Point3d, Polyline, Line
import math

# -------------------------
# Utilities
# -------------------------

def polyline_from_points(pts, close=True):
    pl = Polyline(pts)
    if close and pts and pts[0].DistanceTo(pts[-1]) > 1e-9:
        pl.Add(pts[0])
    return pl

def poly_center(pl):
    """Area centroid for closed polygon; falls back to average if degenerate."""
    pts = list(pl)
    if len(pts) < 4:
        return pts[0]
    if pts[0].DistanceTo(pts[-1]) < 1e-9:
        pts = pts[:-1]
    A = 0.0
    Cx = 0.0
    Cy = 0.0
    for i in range(len(pts)):
        x0, y0 = pts[i].X, pts[i].Y
        x1, y1 = pts[(i+1)%len(pts)].X, pts[(i+1)%len(pts)].Y
        cross = x0*y1 - x1*y0
        A  += cross
        Cx += (x0 + x1)*cross
        Cy += (y0 + y1)*cross
    if abs(A) < 1e-12:
        sx = sum(p.X for p in pts)/len(pts)
        sy = sum(p.Y for p in pts)/len(pts)
        return Point3d(sx, sy, pts[0].Z)
    A *= 0.5
    return Point3d(Cx/(6.0*A), Cy/(6.0*A), pts[0].Z)

def add_edge_unique(edge_set, a, b):
    """Store undirected edges uniquely using rounded coordinate keys."""
    key = lambda p: (round(p.X,6), round(p.Y,6), round(p.Z,6))
    ka, kb = key(a), key(b)
    k = (ka, kb) if ka <= kb else (kb, ka)
    if k not in edge_set:
        edge_set[k] = Line(a, b)

# -------------------------
# Pattern generators
# -------------------------

def gen_square(X, Y, Size, Origin):
    cells = []
    ox, oy, oz = Origin.X, Origin.Y, Origin.Z
    for j in range(Y):
        for i in range(X):
            x0 = ox + i*Size
            y0 = oy + j*Size
            pts = [
                Point3d(x0,       y0,       oz),
                Point3d(x0+Size,  y0,       oz),
                Point3d(x0+Size,  y0+Size,  oz),
                Point3d(x0,       y0+Size,  oz)
            ]
            cells.append(polyline_from_points(pts, True))
    return cells

def gen_tri(X, Y, Size, Origin):
    # Equilateral triangles from staggered rows
    w = Size
    h = Size * math.sqrt(3)/2.0
    cells = []
    ox, oy, oz = Origin.X, Origin.Y, Origin.Z
    for r in range(Y):
        xoff = (w/2.0) if (r % 2) else 0.0
        for c in range(X):
            x0 = ox + c*w + xoff
            y0 = oy + r*h
            pA = Point3d(x0,     y0,    oz)
            pB = Point3d(x0+w/2, y0+h,  oz)
            pC = Point3d(x0+w,   y0,    oz)
            if (c + r) % 2 == 0:
                cells.append(polyline_from_points([pA, pB, pC], True))
            else:
                cells.append(polyline_from_points([pA, Point3d(x0+w/2, y0-h, oz), pC], True))
    return cells

def gen_hex(X, Y, Size, Origin):
    # Pointy-top hex grid (side length = Size)
    s = Size
    w = math.sqrt(3)*s
    h = 1.5*s
    cells = []
    ox, oy, oz = Origin.X, Origin.Y, Origin.Z

    def hex_verts(cx, cy):
        pts = []
        for k in range(6):
            ang = math.radians(60*k - 30)
            pts.append(Point3d(cx + s*math.cos(ang), cy + s*math.sin(ang), oz))
        return pts

    for r in range(Y):
        xoff = 0.0 if (r % 2 == 0) else w/2.0
        for c in range(X):
            cx = ox + c*w + xoff
            cy = oy + r*h
            cells.append(polyline_from_points(hex_verts(cx, cy), True))
    return cells

def gen_weave(X, Y, Size, Origin, band_ratio=0.6):
    # Basket weave strips (horizontal/vertical alternating by row)
    t = max(0.05, min(0.95, band_ratio)) * Size
    cells = []
    ox, oy, oz = Origin.X, Origin.Y, Origin.Z
    for j in range(Y):
        for i in range(X):
            x0 = ox + i*Size
            y0 = oy + j*Size
            if (j % 2) == 0:
                ymid = y0 + 0.5*Size
                pts = [
                    Point3d(x0,        ymid - t/2, oz),
                    Point3d(x0+Size,   ymid - t/2, oz),
                    Point3d(x0+Size,   ymid + t/2, oz),
                    Point3d(x0,        ymid + t/2, oz)
                ]
            else:
                xmid = x0 + 0.5*Size
                pts = [
                    Point3d(xmid - t/2, y0,        oz),
                    Point3d(xmid + t/2, y0,        oz),
                    Point3d(xmid + t/2, y0+Size,   oz),
                    Point3d(xmid - t/2, y0+Size,   oz)
                ]
            cells.append(polyline_from_points(pts, True))
    return cells

def gen_cairo(X, Y, Size, Origin):
    ox, oy, oz = Origin.X, Origin.Y, Origin.Z
    s = Size
    w = math.sqrt(3)*s     # horizontal pitch
    h = 1.5*s              # vertical pitch
    a = 0.5*s
    b = 1.0*s

    def cell(cx, cy, z):
        p1 = Point3d(cx - a, cy - b, z)
        p2 = Point3d(cx + a, cy - b, z)
        p3 = Point3d(cx + b, cy,     z)
        p4 = Point3d(cx,     cy + b, z)
        p5 = Point3d(cx - b, cy,     z)
        return Polyline([p1,p2,p3,p4,p5,p1])

    cells = []
    for r in range(Y):
        xoff = 0.0 if (r % 2 == 0) else w/2.0
        for c in range(X):
            cx = ox + c*w + xoff
            cy = oy + r*h
            cells.append(cell(cx, cy, oz))
    return cells

# -------------------------
# Registry
# -------------------------

def registry_ordered():
    """Ordered pattern list: (key, factory) tuples in stable UI order."""
    return [
        ("square", lambda X,Y,S,O: gen_square(X,Y,S,O)),
        ("tri",    lambda X,Y,S,O: gen_tri(X,Y,S,O)),
        ("hex",    lambda X,Y,S,O: gen_hex(X,Y,S,O)),
        ("weave",  lambda X,Y,S,O: gen_weave(X,Y,S,O,band_ratio=0.6)),
        ("cairo",  lambda X,Y,S,O: gen_cairo(X,Y,S,O)),
    ]

def registry_dict():
    return {k:f for k,f in registry_ordered()}

# -------------------------
# Main
# -------------------------

# Defaults
if X is None or X < 1: X = 10
if Y is None or Y < 1: Y = 10
if Size is None or Size <= 0: Size = 1.0
if Origin is None: Origin = Point3d(0,0,0)

ordered = registry_ordered()
reg = registry_dict()

# Choose by Index if available, else by Pattern text
idx_in = locals().get('Index', None)
if idx_in is not None:
    try:
        i = int(idx_in)
    except:
        i = 0
    if len(ordered) == 0:
        raise Exception("Registry is empty.")
    # Clamp to valid range (change to modulo if wrap-around preferred)
    if i < 0: i = 0
    if i >= len(ordered): i = len(ordered)-1
    name = ordered[i][0]
else:
    token = Pattern or "square"
    try:
        name = str(token).strip().lower()
    except:
        name = "square"

if name not in reg:
    name = "square"

# Generate cells
Cells = reg[name](X, Y, Size, Origin)

# Centers & unique edges
Centers = [poly_center(pl) for pl in Cells]
edge_dict = {}
for pl in Cells:
    pts = list(pl)
    if len(pts) < 2: continue
    if pts[0].DistanceTo(pts[-1]) > 1e-9:
        pts.append(pts[0])
    for j in range(len(pts)-1):
        add_edge_unique(edge_dict, pts[j], pts[j+1])
Edges = list(edge_dict.values())

# Report
idx_lookup = {k:i for i,(k,_) in enumerate(ordered)}
idx = idx_lookup.get(name, -1)
Info = "Index: {} | Pattern: {} | Cells: {} | Edges: {} | Size: {} | Grid: {}x{}".format(
    idx, name, len(Cells), len(Edges), round(Size,3), X, Y
)
# ---------- end cell_creator ----------
panel = Panel(cell_creator.Info)
panel_2 = Panel("""concentric
star
spoke""")
crv = Curve(cell_creator.Cells)
item = ListItem(List=panel_2, Index=Slider(1, range=0..10), Wrap=True)
cell_patternizer = GhPythonScript(
    Cells=cell_creator.Cells,
    Mode=item,
    Inset=Slider(0.593, range=0..1),
    Steps=Slider(5, range=0..10),
    Rotate=Slider(49, range=0..100))  # -> Curves, Cutouts, Cutouts_2, Report; inputs Cells: list of Polyline, Steps: Int32
# ---------- cell_patternizer: Python ----------
__author__ = "FHarker"
__version__ = "2025.10.01"

"""Cell Patternizer (MVP)
Inputs:
    Cells: list[Polyline]  # closed, from grid generator
    Mode: str              # 'concentric', 'star', 'spokes'
    Inset: float           # 0..1, amount toward centroid
    Steps: int             # rings for concentric, spike factor for star (>=1)
    Rotate: float          # degrees, per-cell rotation about centroid
Outputs:
    Curves: list[Rhino.Geometry.Curve]
    Cutouts: list[Rhino.Geometry.Curve]
    Centers: list[Rhino.Geometry.Point3d]
    Report: str
"""
import Rhino
from Rhino.Geometry import *
import math

def centroid_of_curve(crv):
    # For closed planar curves, use area mass properties
    if crv and crv.IsClosed:
        amp = Rhino.Geometry.AreaMassProperties.Compute(crv)
        if amp:
            return amp.Centroid
    # Fallback: bounding-box center
    bb = crv.GetBoundingBox(True)
    return bb.Center


def to_polycurve(pl):
    if isinstance(pl, Polyline):
        return pl.ToPolylineCurve()
    if isinstance(pl, PolylineCurve):
        return pl
    return None

def centroid_of_polyline(pl):
    pts = list(pl)
    if pts[0].DistanceTo(pts[-1]) < 1e-9: pts = pts[:-1]
    A = 0.0; cx = 0.0; cy = 0.0; z = pts[0].Z
    n = len(pts)
    for i in range(n):
        x0, y0 = pts[i].X, pts[i].Y
        x1, y1 = pts[(i+1)%n].X, pts[(i+1)%n].Y
        cross = x0*y1 - x1*y0
        A += cross
        cx += (x0 + x1)*cross
        cy += (y0 + y1)*cross
    if abs(A) < 1e-12:
        sx = sum(p.X for p in pts)/n
        sy = sum(p.Y for p in pts)/n
        return Point3d(sx, sy, z)
    A *= 0.5
    return Point3d(cx/(6.0*A), cy/(6.0*A), z)

def best_plane(crv):
    pln = Plane.Unset
    ok, pln = crv.TryGetPlane()
    if not ok:
        # fall back to world XY
        pln = Plane.WorldXY
    return pln

def rotate_about(pt, angle_deg):
    return Transform.Rotation(math.radians(angle_deg), pt)

def offset_in_plane(crv, pln, dist):
    tol = Rhino.RhinoDoc.ActiveDoc.ModelAbsoluteTolerance
    offs = crv.Offset(pln, dist, tol, CurveOffsetCornerStyle.Sharp)
    return offs or []

def polygon_vertices(pl):
    pts = list(pl)
    if pts[0].DistanceTo(pts[-1]) < 1e-9: pts = pts[:-1]
    return pts

def star_polygon(pl, t=0.25, spike=1, rot_deg=0.0):
    """General star: alternate vertices with points pulled toward centroid by t.
       spike: integer multiplier to permute vertex order (for more spikes)."""
    verts = polygon_vertices(pl)
    n = len(verts)
    if n < 3: return None
    c = centroid_of_polyline(pl)
    order = range(n)
    # spike factor: permute indices (mod n)
    order = [(i*spike) % n for i in range(n)]
    # build 2n point star
    pts = []
    for idx in order:
        v = verts[idx]
        pts.append(v)
        toward = Point3d(c.X + (v.X - c.X)*(1.0 - t), c.Y + (v.Y - c.Y)*(1.0 - t), v.Z)
        pts.append(toward)
    pts.append(pts[0])
    plc = Polyline(pts).ToPolylineCurve()
    if rot_deg:
        plc.Transform(rotate_about(c, rot_deg))
    return plc

def spoke_lines(pl, rot_deg=0.0):
    verts = polygon_vertices(pl)
    c = centroid_of_polyline(pl)
    ln = []
    for v in verts:
        a, b = c, v
        line = Line(a, b).ToNurbsCurve()
        if rot_deg:
            line.Transform(rotate_about(c, rot_deg))
        ln.append(line)
    # also mid-edge spokes for “plus-like” effect
    for i in range(len(verts)):
        a = verts[i]; b = verts[(i+1)%len(verts)]
        mid = Point3d((a.X+b.X)/2.0, (a.Y+b.Y)/2.0, a.Z)
        line = Line(c, mid).ToNurbsCurve()
        if rot_deg:
            line.Transform(rotate_about(c, rot_deg))
        ln.append(line)
    return ln

def concentric_insets(pl, k=0.15, steps=3, rot_deg=0.0):
    """Create inward offsets (concentric rings) of a polygonal cell.
       k: fraction of average edge length used as offset distance per ring.
    """
    plc = to_polycurve(pl)
    if plc is None:
        return []

    pln = best_plane(plc)

    # average edge length for a scale-aware offset distance
    verts = polygon_vertices(pl)
    avg = 0.0
    for i in range(len(verts)):
        avg += verts[i].DistanceTo(verts[(i+1) % len(verts)])
    avg /= max(1, len(verts))

    d = -k * avg  # inward offset

    tol = Rhino.RhinoDoc.ActiveDoc.ModelAbsoluteTolerance
    rings = []
    crvs = [plc]
    for _ in range(steps):
        next_crvs = []
        for c in crvs:
            offs = c.Offset(pln, d, tol, Rhino.Geometry.CurveOffsetCornerStyle.Sharp)
            if not offs:
                continue
            for oc in offs:
                if rot_deg:
                    ctr = centroid_of_curve(oc)
                    oc.Transform(Transform.Rotation(math.radians(rot_deg), ctr))
                next_crvs.append(oc)
                rings.append(oc)
        crvs = next_crvs
        if not crvs:
            break

    return rings

# defaults
if not Mode: Mode = "concentric"
if Inset is None: Inset = 0.2
if Steps is None or Steps < 1: Steps = 3
if Rotate is None: Rotate = 0.0

Curves, Cutouts, Centers = [], [], []
count = 0

for pl in Cells or []:
    if not isinstance(pl, Polyline): 
        # try convert from curve with points
        continue
    c = centroid_of_polyline(pl)
    Centers.append(c)
    if Mode == "concentric":
        rings = concentric_insets(pl, k=max(0.01, min(0.9, Inset)), steps=Steps, rot_deg=Rotate)
        Curves.extend(rings)
        # the innermost ring is typically a good cutout
        if rings: Cutouts.append(rings[-1])
        count += 1
    elif Mode == "star":
        spike = max(1, int(Steps))
        sc = star_polygon(pl, t=max(0.01, min(0.9, Inset)), spike=spike, rot_deg=Rotate)
        if sc: 
            Curves.append(sc)
            Cutouts.append(sc)  # closed curve suitable for perforation
            count += 1
    elif Mode == "spokes":
        ln = spoke_lines(pl, rot_deg=Rotate)
        Curves.extend(ln)
        count += 1
    else:
        # passthrough
        pc = to_polycurve(pl)
        if pc: Curves.append(pc)

Report = "Cells: {} | Mode: {} | Inset: {} | Steps: {} | Rot: {}°".format(
    len(Cells or []), Mode, round(Inset,3), Steps, round(Rotate,2)
)
# ---------- end cell_patternizer ----------

# ----
# USER INPUTS
number_slider_2 = Slider(0.95, range=0..1)
# USER INPUTS
number_slider_3 = Slider(0.46, range=0..10)
number_slider_4 = Slider(37, range=0..100)

circle = Circle({Plane=Plane(origin=(3.866552249, 12.45932186, 0), x=(0.8404591185, 0.541874958, 0), y=(-0.541874958, 0.8404591185, 0)), Radius=23.83735162})

crv_2 = Curve(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)
number_slider_5 = Slider(73, range=0..100)
number_slider_6 = Slider(4, range=0..10)
number_slider_7 = Slider(24, range=0..100)
number_slider_8 = Slider(24, range=0..100)
pt_2 = Point(Point(0, 0, 0))
crv_3 = Curve(crv_2)
number_slider_9 = Slider(2.2, range=0..10)
pt_3 = Point(Point(0, 0, 0))
pt_4 = Point(Point(8.360929721, 11.31869829, 0))
number_slider_10 = Slider(24, range=0..100)
neg = Negative(Value=Slider(9.43, range=0..10))
point_attracted_grid = GhPythonScript(
    base_scale=number_slider_3,
    extent_x=number_slider_4,
    extent_y=number_slider_4,
    attractor_point_x_coord=Slider(8.97, range=0..10),
    attractor_point_y_coord=Slider(4.94, range=0..10),
    scale_closest_point=Slider(0.08, range=0..1),
    scale_farthest_point=number_slider_2)  # -> scaled_grid_cells; inputs extent_x: Int32, extent_y: Int32
# ---------- point_attracted_grid: Python ----------
# Grasshopper Component Inputs
# base_scale: The nominal size of each grid cell before attraction scaling. (Type Hint: float)
# extent_x: The total width of the grid. (Type Hint: float)
# extent_y: The total height of the grid. (Type Hint: float)
# attractor_point_x_coord: X coordinate of the attractor point. (Type Hint: float)
# attractor_point_y_coord: Y coordinate of the attractor point. (Type Hint: float)
# scale_closest_point: The scaling factor for cells closest to the attractor. (Type Hint: float)
# scale_farthest_point: The scaling factor for cells farthest from the attractor. (Type Hint: float)
# ---
# Grasshopper Component Outputs
# scaled_grid_cells: A list of scaled rectangular grid cells.

import Rhino.Geometry as rg
import math

# --- Input Coercion and Type Casting ---
# Ensure all inputs are correctly typed, especially floats from sliders.
base_scale = float(base_scale)
extent_x = float(extent_x)
extent_y = float(extent_y)
attractor_point_x_coord = float(attractor_point_x_coord)
attractor_point_y_coord = float(attractor_point_y_coord)
scale_closest_point = float(scale_closest_point)
scale_farthest_point = float(scale_farthest_point)

# Initialize output list
scaled_grid_cells = []

# --- Attractor Point Setup ---
# Create the attractor point in 3D space (assuming Z=0 for a 2D grid).
attractor_pt = rg.Point3d(attractor_point_x_coord, attractor_point_y_coord, 0)

# --- Determine Grid Dimensions ---
# Calculate the number of cells in X and Y directions based on the total extent
# and the nominal base_scale. This ensures the grid covers the specified area.
num_cells_x = int(extent_x / base_scale)
num_cells_y = int(extent_y / base_scale)

# Ensure at least one cell in each direction to avoid division by zero or empty grids.
# If base_scale is larger than extent, num_cells could be 0.
if num_cells_x == 0: num_cells_x = 1
if num_cells_y == 0: num_cells_y = 1

# Calculate the actual nominal width and height of each cell.
# This ensures that the grid of cell CENTERS perfectly tiles the extent_x by extent_y area.
nominal_cell_width = extent_x / num_cells_x
nominal_cell_height = extent_y / num_cells_y

# --- Calculate Cell Centers and Distances to Attractor ---
# Store cell centers and their distances to the attractor point for later processing.
all_distances = []
cell_data = [] # Stores (center_point, distance) tuples

# Iterate through the grid to calculate each cell's center and its distance to the attractor.
for i in range(num_cells_x):
    for j in range(num_cells_y):
        # Calculate the center of the current cell.
        # The grid starts from (0,0) and extends to (extent_x, extent_y).
        center_x = (i + 0.5) * nominal_cell_width
        center_y = (j + 0.5) * nominal_cell_height
        cell_center = rg.Point3d(center_x, center_y, 0)

        # Calculate distance from cell center to the attractor point.
        dist = cell_center.DistanceTo(attractor_pt)
        all_distances.append(dist)
        cell_data.append((cell_center, dist))

# --- Determine Min/Max Distances for Normalization ---
if not all_distances: # Handle case where no cells were generated (e.g., extent_x or extent_y was 0)
    scaled_grid_cells = [] # Output an empty list
else:
    min_dist = min(all_distances)
    max_dist = max(all_distances)

    # --- Generate Scaled Cells ---
    for cell_center, dist in cell_data:
        # Calculate normalized distance (0 for closest, 1 for farthest).
        normalized_dist = 0.0
        # Avoid division by zero if all distances are the same (e.g., only one cell or attractor at center).
        if max_dist - min_dist > 1e-9: # Use a small epsilon for float comparison robustness
            normalized_dist = (dist - min_dist) / (max_dist - min_dist)
        else:
            # If all distances are identical, apply an average scale.
            normalized_dist = 0.5

        # Map the normalized distance to the desired scale range.
        # Closest points get scale_closest_point, farthest get scale_farthest_point.
        scale_factor = scale_closest_point + normalized_dist * (scale_farthest_point - scale_closest_point)

        # Calculate the half dimensions of the scaled cell.
        half_scaled_width = (nominal_cell_width * scale_factor) / 2.0
        half_scaled_height = (nominal_cell_height * scale_factor) / 2.0

        # Create intervals for the rectangle dimensions, centered at (0,0,0).
        x_interval = rg.Interval(-half_scaled_width, half_scaled_width)
        y_interval = rg.Interval(-half_scaled_height, half_scaled_height)

        # Create a rectangle (Rectangle3d) centered at (0,0,0) with the scaled dimensions.
        # The plane is WorldXY (Z=0).
        scaled_rect = rg.Rectangle3d(rg.Plane.WorldXY, x_interval, y_interval)

        # Create a translation transformation to move the rectangle from (0,0,0) to its cell center.
        transform = rg.Transform.Translation(cell_center.X, cell_center.Y, 0)

        # Apply the transformation to the rectangle.
        scaled_rect.Transform(transform)

        # Add the transformed rectangle to the output list.
        scaled_grid_cells.append(scaled_rect)

# --- Output Assignment ---
# Assign the list of scaled rectangles to the output variable.
scaled_grid_cells = scaled_grid_cells
# ---------- end point_attracted_grid ----------
populate_with_points = GhPythonScript(Crv=circle, N=Slider(436, range=0..1000), Seed=Slider(2, range=0..10))  # -> Pts; inputs Crv: Curve, N: Int32, Seed: Int32
# ---------- populate_with_points: Python ----------
import Rhino.Geometry as rg
import random
import scriptcontext as sc

# Ensure N and Seed are integers, as they might come from a float slider
N = int(N)
Seed = int(Seed)

# Initialize the list for output points
Pts = []

# --- Input Validation ---
if Crv is None:
    print("Error: Input curve 'Crv' is null.")
elif not Crv.IsClosed:
    print("Error: Input curve 'Crv' must be closed.")
elif N <= 0:
    print("Error: Number of points 'N' must be greater than zero.")
else:
    # Set the random seed for reproducible results
    random.seed(Seed)

    # Get the bounding box of the curve to define the search area
    bbox = Crv.GetBoundingBox(True)
    if not bbox.IsValid:
        print("Error: Could not get a valid bounding box for the curve.")
    else:
        min_x, min_y, min_z = bbox.Min.X, bbox.Min.Y, bbox.Min.Z
        max_x, max_y, max_z = bbox.Max.X, bbox.Max.Y, bbox.Max.Z

        # Get the document tolerance for curve containment checks
        tolerance = sc.doc.ModelAbsoluteTolerance

        # Define a plane for the containment check.
        # Assuming the curve is planar or projected onto the WorldXY plane for point generation.
        # If the curve is truly 3D and you need points on its surface, a different approach is needed.
        # For "inside a closed curve", WorldXY is the most common interpretation.
        test_plane = rg.Plane.WorldXY

        # Counter for generated points
        points_found = 0
        # Safeguard to prevent infinite loops if the curve area is tiny or N is very large
        max_attempts = N * 1000 # Try N * 1000 times before giving up

        attempts = 0
        while points_found < N and attempts < max_attempts:
            # Generate random coordinates within the bounding box
            rand_x = random.uniform(min_x, max_x)
            rand_y = random.uniform(min_y, max_y)
            # For Z, we can use the average Z of the bounding box or just 0 if planar
            # Using the Z of the bounding box minimum to keep points at a consistent height
            rand_z = min_z 
            
            test_point = rg.Point3d(rand_x, rand_y, rand_z)

            # Check if the point is inside the curve
            # CurveContainment.Inside means the point is strictly inside
            # CurveContainment.Coincident means the point is on the curve boundary
            # We want strictly inside for "populates"
            containment = Crv.Contains(test_point, test_plane, tolerance)

            # CORRECTED LINE: Compare with rg.PointContainment.Inside
            if containment == rg.PointContainment.Inside:
                Pts.append(test_point)
                points_found += 1
            
            attempts += 1
        
        if points_found < N:
            print("Warning: Only {} points were found after {} attempts. Consider increasing max_attempts or checking curve area.".format(points_found, attempts))
# ---------- end populate_with_points ----------
rectangular_grid_generator = RectangularGridGenerator(
    origin_point=pt_2,
    scale_x_axis=number_slider_6,
    scale_y_axis=number_slider_6,
    x_axis_extent=number_slider_7,
    y_axis_extent=number_slider_7)  # -> grid_cell_curves_2, grid_area_centroids
pt_5 = Point(Point(0, 0, 0))
offset = OffsetCurve(Curve=crv_3, Distance=neg, Plane=PlaneXY(0, 0, 0), Corners=1)
python = GhPythonScript(
    CellSize=Slider(5.07, range=0..10),
    ExtentX=number_slider_8,
    ExtentY=number_slider_8,
    Hmin=Slider(0.38, range=0..10),
    Hmax=Slider(1.72, range=0..10),
    Alternate=Slider(0, range=0..1),
    AttractorPts=pt_4,
    BasePlane=pt_3)  # -> a, M, Apex, H, Creases, MV, NX, NY; inputs Alternate: Boolean, AttractorPts: list of Point3d, AttractorCrvs: list of Curve, BasePlane: Plane
# ---------- python: Python ----------
import Rhino.Geometry as rg
import math

# ---------- helpers ----------
def nearest_distance(pt, curves, pts):
    d = float("inf")
    if curves:
        for c in curves:
            ok, t = c.ClosestPoint(pt)
            if ok:
                q = c.PointAt(t)
                dist = pt.DistanceTo(q)
                if dist < d: d = dist
    if pts:
        for p in pts:
            dist = pt.DistanceTo(p)
            if dist < d: d = dist
    return None if d == float("inf") else d

def remap(vals, new_min=0.0, new_max=1.0):
    if not vals: return []
    lo, hi = min(vals), max(vals)
    if abs(hi - lo) < 1e-9:
        # flat field → all zeros
        return [0.0 for _ in vals]
    s = (new_max - new_min) / float(hi - lo)
    return [new_min + (v - lo) * s for v in vals]

# ---------- parameters from inputs ----------
S = max(1e-6, float(CellSize))              # equilateral edge length
step_x = S
step_y = S * math.sqrt(3.0) * 0.5          # vertical pitch for equilateral grid

# derive counts from extents (fixed panel size)
NX = max(1, int(math.floor(ExtentX / step_x)))
NY = max(1, int(math.floor(ExtentY / step_y)))

# make centered rectangle on BasePlane
rect = rg.Rectangle3d(BasePlane,
                      rg.Interval(-0.5*ExtentX, 0.5*ExtentX),
                      rg.Interval(-0.5*ExtentY, 0.5*ExtentY))
boundary = rect.ToNurbsCurve()

# ---------- staggered equilateral lattice (overscan by +1) ----------
grid = [[None]*(NX+2) for _ in range(NY+2)]
y0 = -0.5*ExtentY
x0 = -0.5*ExtentX
for j in range(NY+2):
    y = y0 + j*step_y
    xoff = (S * 0.5) if (j % 2 == 1) else 0.0
    for i in range(NX+2):
        x = x0 + i*step_x + xoff
        grid[j][i] = BasePlane.PointAt(x, y)

# build triangles (two per rhombus)
tris_all = []
for j in range(NY+1):
    odd = (j % 2 == 1)
    for i in range(NX+1):
        p00 = grid[j][i]
        p10 = grid[j][i+1]
        p01 = grid[j+1][i]
        p11 = grid[j+1][i+1]
        if odd:
            tris_all.append((p00, p10, p11))
            tris_all.append((p00, p11, p01))
        else:
            tris_all.append((p00, p10, p01))
            tris_all.append((p10, p11, p01))

# cull triangles by rectangle (centroid inclusion)
tris = []
centroids = []
for A,B,C in tris_all:
    pl = rg.Polyline([A,B,C,A]).ToNurbsCurve()
    amp = rg.AreaMassProperties.Compute(pl)
    if amp is None: continue
    cen = amp.Centroid
    cont = rect.Contains(cen)
    if cont != rg.PointContainment.Outside:
        tris.append((A,B,C))
        centroids.append(cen)

# ---------- scalar field from attractors (fallback: X-ramp) ----------
dists = []
for c in centroids:
    d = nearest_distance(c, AttractorCrvs, AttractorPts)
    if d is None:
        # fallback: left→right gradient in BasePlane UV
        u,v,w = BasePlane.ClosestPoint(c)
        d = u
    dists.append(d)

t = remap(dists, 0.0, 1.0)                      # 0..1
heights = [Hmin + (Hmax - Hmin) * ti for ti in t]

# mountain/valley mask
if Alternate:
    MV = [1 if (k % 2 == 0) else -1 for k in range(len(tris))]
else:
    MV = [1]*len(tris)

# ---------- build faceted mesh ----------
mesh = rg.Mesh()
Apex = []
Creases = []
n = BasePlane.ZAxis

for idx,(A,B,C) in enumerate(tris):
    cen = centroids[idx]
    h = heights[idx] * MV[idx]
    P = cen + n * h
    Apex.append(P)

    vA = mesh.Vertices.Add(A)
    vB = mesh.Vertices.Add(B)
    vC = mesh.Vertices.Add(C)
    vP = mesh.Vertices.Add(P)

    mesh.Faces.AddFace(vA, vB, vP)
    mesh.Faces.AddFace(vB, vC, vP)
    mesh.Faces.AddFace(vC, vA, vP)

    Creases.extend([rg.Line(cen, A), rg.Line(cen, B), rg.Line(cen, C)])

mesh.Normals.ComputeNormals()
mesh.UnifyNormals()
mesh.Weld(math.radians(30.0))

# outputs
M = mesh
H = heights
# ---------- end python ----------
hex_grid_generator = HexGridGenerator(origin_point=pt_5, cell_scale=number_slider_9, x_axis_extent=number_slider_10, y_axis_extent=number_slider_10)  # -> flatten(grid_cell_curves_2), flatten(grid_area_centroids)
# OUTPUT
point = Point(populate_with_points)
crv_4 = Curve(offset)
divide = DivideCurve(Curve=crv_3, Count=number_slider_5, Kinks=False)  # -> Points, Tangents, Parameters
# OUTPUT
curve = Curve(point_attracted_grid)
panel_3 = Panel("""square
tri
hex
weave
cairo""")
geo = Geometry(python.Creases)
geo_2 = Geometry(python.M)
geo_3 = Geometry(python.Apex)
Z = UnitZ(Factor=Slider(7.23, range=0..10))
move = Move(Geometry=crv_4, Motion=Z)  # -> Geometry, Transform
# USER INPUTS
number_slider_11 = Slider(0.46, range=0..10)
# OUTPUT
curve_2 = Curve([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])
divide_2 = DivideCurve(Curve=move.Geometry, Count=number_slider_5, Kinks=False)  # -> Points, Tangents, Parameters
grid_eval_tool = GridEvalTool(
    grid_cell_curves=rectangular_grid_generator.grid_cell_curves_2,
    grid_cell_scale=Slider(0.41, range=0..1),
    eval_point_a=Slider(0.28, range=0..1),
    eval_point_b=Slider(0.04, range=0..1))  # -> grid_cell_curves_4, scaled_grid_cell_curves_2, grid_cell_area_centroid_2, grid_cell_vertices_2, scaled_grid_cell_vertices_2, grid_cell_midpoints_2, scaled_grid_cell_midpoints_2, evaluated_point_on_seg_2, scaled_evaluated_point_on_seg_2
pt_6 = Point(divide_2.Points)
pt_7 = Point(divide.Points)
item_2 = ListItem(List=hex_grid_generator.grid_area_centroids, Index=0, Wrap=True)
item_3 = ListItem(List=hex_grid_generator.grid_cell_curves_2, Index=0, Wrap=True)
disc = Discontinuity(Curve=item_3, Level=1)  # -> Points, Parameters
scale = Scale(Geometry=hex_grid_generator.grid_cell_curves_2, Center=hex_grid_generator.grid_area_centroids, Factor=0.5)  # -> Geometry, Transform
ln = Line(StartPoint=pt_7, EndPoint=pt_6)
disc_2 = Discontinuity(Curve=scale.Geometry, Level=1)  # -> Points, Parameters
loft = Loft(Curves=ln, Options={Adjust=False, Closed=False, LoftEnds=0, LoftSimp=0, LoftType=0, Rebuild=10, Refit=0.01})
number_slider_12 = Slider(120, range=0..1000)
multiplication = Multiplication(A=number_slider_9, B=Slider(0.459, range=0..1))
number_slider_13 = Slider(0, range=0..100)
eval = EvaluateCurve(Curve=reparameterize(ln), Parameter=Slider(0.375, range=0..1))  # -> Point, Tangent, Angle
pipe = Pipe(Curve=ln, Radius=Slider(0.17, range=0..10), Caps=0)
number_slider_14 = Slider(24, range=0..100)
number_slider_15 = Slider(4, range=0..10)
number_slider_16 = Slider(24, range=0..100)
series = Series(Start=number_slider_12, Step=number_slider_12, Count=disc.Points)
number_slider_17 = Slider(24, range=0..100)
polygon = Polygon(Plane=disc_2.Points, Radius=multiplication, Segments=Slider(6, range=0..10), FilletRadius=0)  # -> Polygon, Length
pt_8 = Point(Point(0, 0, 0))
pt_9 = Point(Point(0, 0, 0))
pt_10 = Point(Point(0, 0, 0))
sph = Sphere(Base=eval.Point, Radius=Slider(0.691, range=0..1))
hex_grid_generator_2 = HexGridGenerator(origin_point=pt_8, cell_scale=Slider(4, range=0..10), x_axis_extent=number_slider_14, y_axis_extent=number_slider_14)  # -> grid_cell_curves_2, grid_area_centroids
area = Area(Geometry=polygon.Polygon)  # -> Area, Centroid
rectangular_grid_generator_2 = RectangularGridGenerator(
    origin_point=pt_9,
    scale_x_axis=number_slider_15,
    scale_y_axis=number_slider_15,
    x_axis_extent=number_slider_16,
    y_axis_extent=number_slider_16)  # -> grid_cell_curves_2, grid_area_centroids
hex_grid_generator_3 = HexGridGenerator(origin_point=pt_10, cell_scale=Slider(4, range=0..10), x_axis_extent=number_slider_17, y_axis_extent=number_slider_17)  # -> grid_cell_curves_2, grid_area_centroids
rotate = Rotate(Geometry=polygon.Polygon, Angle=degrees(series), Plane=area.Centroid)  # -> Geometry, Transform
grid_eval_tool_2 = GridEvalTool(grid_cell_curves=hex_grid_generator_2.grid_cell_curves_2, grid_cell_scale=Slider(0.56, range=0..1))  # -> grid_cell_curves_4, scaled_grid_cell_curves_2, grid_cell_area_centroid_2, grid_cell_vertices_2, scaled_grid_cell_vertices_2, grid_cell_midpoints_2, scaled_grid_cell_midpoints_2, evaluated_point_on_seg_2, scaled_evaluated_point_on_seg_2
grid_eval_tool_3 = GridEvalTool(
    grid_cell_curves=rectangular_grid_generator_2.grid_cell_curves_2,
    grid_cell_scale=Slider(0.67, range=0..1),
    eval_point_a=Slider(0.27, range=0..1),
    eval_point_b=Slider(1, range=0..1))  # -> grid_cell_curves_4, scaled_grid_cell_curves_2, grid_cell_area_centroid_2, grid_cell_vertices_2, scaled_grid_cell_vertices_2, grid_cell_midpoints_2, scaled_grid_cell_midpoints_2, evaluated_point_on_seg_2, scaled_evaluated_point_on_seg_2
grid_eval_tool_4 = GridEvalTool(
    grid_cell_curves=hex_grid_generator_3.grid_cell_curves_2,
    grid_cell_scale=Slider(0.67, range=0..1),
    eval_point_a=Slider(0.27, range=0..1),
    eval_point_b=Slider(1, range=0..1))  # -> grid_cell_curves_4, scaled_grid_cell_curves_2, grid_cell_area_centroid_2, grid_cell_vertices_2, scaled_grid_cell_vertices_2, grid_cell_midpoints_2, scaled_grid_cell_midpoints_2, evaluated_point_on_seg_2, scaled_evaluated_point_on_seg_2
ln_2 = Line(StartPoint=grid_eval_tool_2.grid_cell_vertices_2, EndPoint=grid_eval_tool_2.scaled_grid_cell_vertices_2)
ln_3 = Line(StartPoint=grid_eval_tool_2.scaled_grid_cell_midpoints_2, EndPoint=grid_eval_tool_2.grid_cell_area_centroid_2)
ln_4 = Line(StartPoint=grid_eval_tool_2.scaled_grid_cell_midpoints_2, EndPoint=grid_eval_tool_2.scaled_grid_cell_vertices_2)
dispatch = Dispatch(List=grid_eval_tool_4.scaled_evaluated_point_on_seg_2, DispatchPattern=[True, False])  # -> ListA, ListB
ln_5 = Line(StartPoint=grid_eval_tool_4.evaluated_point_on_seg_2, EndPoint=grid_eval_tool_4.scaled_evaluated_point_on_seg_2)
crv_5 = Curve([ln_2, ln_3, ln_4])
ln_6 = Line(StartPoint=grid_eval_tool_2.grid_cell_area_centroid_2, EndPoint=flatten(hex_grid_generator_2.grid_area_centroids))
shift = ShiftList(List=dispatch.ListA, Shift=Slider(3, range=0..10), Wrap=True)
ln_7 = Line(StartPoint=shift, EndPoint=dispatch.ListB)
srfsplit = SurfaceSplit(Surface=grid_eval_tool_2.grid_cell_curves_4, Curves=crv_5)
number_slider_18 = Slider(0.666, range=0..1)
item_4 = ListItem(List=grid_eval_tool_3.grid_cell_vertices_2, Index=0, Wrap=True)  # -> Item, Item1, Item2, Item3
crv_6 = Curve(flatten([ln_5, ln_7]))
move_2 = Move(Geometry=graft(srfsplit), Motion=ln_6)  # -> flatten(Geometry), Transform
pt_11 = Point(item_4.Item)
pt_12 = Point(item_4.Item1)
pt_13 = Point(item_4.Item2)
pt_14 = Point(item_4.Item3)
area_2 = Area(Geometry=move_2.Geometry)  # -> Area, Centroid
srfsplit_2 = SurfaceSplit(Surface=grid_eval_tool_4.grid_cell_curves_4, Curves=crv_6)
ln_8 = Line(StartPoint=pt_13, EndPoint=pt_14)
ln_9 = Line(StartPoint=pt_11, EndPoint=pt_12)
pt_15 = Point(grid_eval_tool_4.evaluated_point_on_seg_2)
pt_16 = Point(Point(0, 0, 0))
eval_2 = EvaluateCurve(Curve=reparameterize(ln_8), Parameter=number_slider_18)  # -> Point, Tangent, Angle
eval_3 = EvaluateCurve(Curve=reparameterize(ln_9), Parameter=number_slider_18)  # -> Point, Tangent, Angle
cull_i = CullIndex(List=srfsplit_2, Indices=Slider(0, range=0..100), Wrap=True)
dispatch_2 = Dispatch(List=pt_15, DispatchPattern=[True, False])  # -> ListA, ListB
hex_grid_generator_4 = HexGridGenerator(
    origin_point=pt_16,
    cell_scale=Slider(0.5, range=0..10),
    x_axis_extent=Slider(4, range=0..10),
    y_axis_extent=Slider(8, range=0..100))  # -> flatten(grid_cell_curves_2), flatten(grid_area_centroids)
Z_2 = UnitZ(Factor=Slider(0.663, range=0..10))
scale_2 = Scale(Geometry=move_2.Geometry, Center=area_2.Centroid, Factor=Slider(0.75, range=0..1))  # -> Geometry, Transform
ln_10 = Line(StartPoint=pt_11, EndPoint=pt_13)
move_3 = Move(Geometry=eval_2.Point, Motion=Z_2)  # -> Geometry, Transform
move_4 = Move(Geometry=eval_3.Point, Motion=Z_2)  # -> Geometry, Transform
area_3 = Area(Geometry=cull_i)  # -> Area, Centroid
weave = Weave(Pattern=[0, 1], Stream0=area_3.Centroid, Stream1=dispatch_2.ListA, NullGaps=False)
ln_11 = Line(StartPoint=pt_11, EndPoint=pt_13)
ln_12 = Line(StartPoint=pt_11, EndPoint=move_3.Geometry)
ln_13 = Line(StartPoint=pt_14, EndPoint=move_3.Geometry)
ln_14 = Line(StartPoint=pt_13, EndPoint=move_3.Geometry)
pline = PolyLine(Vertices=weave, Closed=True)
ln_15 = Line(StartPoint=pt_11, EndPoint=pt_14)
ln_16 = Line(StartPoint=pt_13, EndPoint=pt_14)
item_5 = ListItem(List=hex_grid_generator_4.grid_cell_curves_2, Index=0, Wrap=True)
item_6 = ListItem(List=hex_grid_generator_4.grid_area_centroids, Index=0, Wrap=True)
edgesrf = EdgeSurface(CurveA=ln_12, CurveB=ln_13, CurveC=ln_15)
edgesrf_2 = EdgeSurface(CurveA=ln_12, CurveB=ln_14, CurveC=ln_11)
edgesrf_3 = EdgeSurface(CurveA=ln_15, CurveB=ln_11, CurveC=ln_16)
edgesrf_4 = EdgeSurface(CurveA=ln_13, CurveB=ln_14, CurveC=ln_16)
srfsplit_3 = SurfaceSplit(Surface=grid_eval_tool_4.grid_cell_curves_4, Curves=crv_6)
scale_3 = Scale(Geometry=item_5, Center=item_6, Factor=0.5)  # -> Geometry, Transform
midpt = CurveMiddle(Curve=ln_11)
mjoin = MeshJoin(Meshes=[edgesrf, edgesrf_2, edgesrf_4, edgesrf_3])
srfsplit_4 = SurfaceSplit(Surface=srfsplit_3, Curves=pline)
explode = Explode(Curve=scale_3.Geometry, Recursive=True)  # -> Segments, Vertices
explode_2 = Explode(Curve=item_5, Recursive=True)  # -> Segments, Vertices
disc_3 = Discontinuity(Curve=item_5, Level=1)  # -> Points, Parameters
disc_4 = Discontinuity(Curve=scale_3.Geometry, Level=1)  # -> Points, Parameters
area_4 = Area(Geometry=srfsplit_4)  # -> Area, Centroid
midpt_2 = CurveMiddle(Curve=explode.Segments)
midpt_3 = CurveMiddle(Curve=explode_2.Segments)
rotate_2 = Rotate(Geometry=mjoin, Angle=degrees(Slider(180, range=0..1000)), Plane=midpt)  # -> Geometry, Transform
scale_4 = Scale(Geometry=srfsplit_4, Center=area_4.Centroid, Factor=Slider(0.92, range=0..1))  # -> Geometry, Transform
shift_2 = ShiftList(List=midpt_3, Shift=Slider(5, range=0..10), Wrap=True)
ln_17 = Line(StartPoint=disc_4.Points, EndPoint=item_6)
geo_4 = Geometry([rotate_2.Geometry, mjoin])
ln_18 = Line(StartPoint=shift_2, EndPoint=disc_4.Points)
ln_19 = Line(StartPoint=midpt_3, EndPoint=disc_4.Points)
weave_2 = Weave(Pattern=[0, 1, 2], Stream0=ln_18, Stream1=ln_19, Stream2=ln_17, NullGaps=False)
srfsplit_5 = SurfaceSplit(Surface=item_5, Curves=weave_2)
crv_7 = Curve(<curve referenced from the Rhino model>)
area_5 = Area(Geometry=srfsplit_5)  # -> Area, Centroid
crv_8 = Curve(srfsplit_5)
ln_20 = Line(StartPoint=item_6, EndPoint=hex_grid_generator_4.grid_area_centroids)
move_5 = Move(Geometry=crv_8, Motion=graft(ln_20))  # -> flatten(Geometry), Transform
area_6 = Area(Geometry=move_5.Geometry)  # -> Area, Centroid
curve_attractor = CurveAttractor(C=crv_7, P=area_6.Centroid, A=Slider(0.658, range=0..1), B=Slider(0.124, range=0..1))  # -> R, points_on_curve_2
scale_5 = Scale(Geometry=move_5.Geometry, Center=area_6.Centroid, Factor=curve_attractor.R)  # -> Geometry, Transform

# ==== cluster HexGridGenerator: Grid Gen
y_axis_extent = ClusterInput()
x_axis_extent = ClusterInput()
in = ClusterInput()  # "---------------------"
origin_point = ClusterInput()
cell_scale = ClusterInput()
y_axis_extent_2 = Number(y_axis_extent)
x_axis_extent_2 = Number(x_axis_extent)
cell_scale_2 = Number(cell_scale)
origin_point_2 = Point(origin_point)
division = Division(XAxisExtent=x_axis_extent_2, B=cell_scale_2)
division_2 = Division(YAxisExtent=y_axis_extent_2, B=cell_scale_2)
hexgrid = Hexagonal(Plane=origin_point_2, Size=cell_scale_2, ExtentX=division, ExtentY=division_2)  # -> Cells, Points
grid_cell_curves = Curve(hexgrid.Cells)
area = Area(Geometry=grid_cell_curves)  # -> Area, GridAreaCentroids
grid_area_centroids = ClusterOutput(area.GridAreaCentroids)
grid_cell_curves_2 = ClusterOutput(grid_cell_curves)

# ==== cluster GridEvalTool: Grid Gen
grid_cell_curves = ClusterInput()
grid_cell_curves_2 = Curve(flatten(grid_cell_curves))
eval_point_b = ClusterInput()
grid_cell_scale = ClusterInput()
eval_point_a = ClusterInput()
item = ListItem(List=grid_cell_curves_2, Index=0, Wrap=True)
grid_cell_scale_2 = Number(grid_cell_scale)
eval_point_b_2 = Number(eval_point_b)
eval_point_a_2 = Number(eval_point_a)
area = Area(Geometry=item)  # -> Area, Centroid
scale = Scale(Geometry=item, Center=area.Centroid, Factor=grid_cell_scale_2)  # -> Geometry, Transform
scaled_grid_cell_curves = Curve(scale.Geometry)
grid_cell_curves_3 = Curve(item)
grid_cell_area_centroid = Point(area.Centroid)
disc = Discontinuity(Curve=scaled_grid_cell_curves, Level=1)  # -> Points, Parameters
explode = Explode(Curve=scaled_grid_cell_curves, Recursive=True)  # -> Segments, Vertices
disc_2 = Discontinuity(Curve=grid_cell_curves_3, Level=1)  # -> Points, Parameters
explode_2 = Explode(Curve=grid_cell_curves_3, Recursive=True)  # -> Segments, Vertices
scaled_grid_cell_vertices = Point(disc.Points)
midpt = CurveMiddle(Curve=explode.Segments)
explode_3 = Explode(Curve=grid_cell_curves_3, Recursive=True)  # -> Segments, Vertices
explode_4 = Explode(Curve=scaled_grid_cell_curves, Recursive=True)  # -> Segments, Vertices
grid_cell_vertices = Point(disc_2.Points)
scaled_grid_cell_midpoints = Point(midpt)
midpt_2 = CurveMiddle(Curve=explode_2.Segments)
eval = EvaluateCurve(Curve=explode_3.Segments, Parameter=eval_point_a_2)  # -> Point, Tangent, Angle
eval_2 = EvaluateCurve(Curve=explode_4.Segments, Parameter=eval_point_b_2)  # -> Point, Tangent, Angle
grid_cell_midpoints = Point(midpt_2)
scaled_grid_cell_curves_2 = ClusterOutput(scaled_grid_cell_curves)
scaled_grid_cell_vertices_2 = ClusterOutput(scaled_grid_cell_vertices)
grid_cell_curves_4 = ClusterOutput(grid_cell_curves_3)
grid_cell_area_centroid_2 = ClusterOutput(grid_cell_area_centroid)
grid_cell_vertices_2 = ClusterOutput(grid_cell_vertices)
scaled_evaluated_point_on_seg = Point(eval_2.Point)
scaled_grid_cell_midpoints_2 = ClusterOutput(scaled_grid_cell_midpoints)
evaluated_point_on_seg = Point(eval.Point)
grid_cell_midpoints_2 = ClusterOutput(grid_cell_midpoints)
evaluated_point_on_seg_2 = ClusterOutput(evaluated_point_on_seg)
scaled_evaluated_point_on_seg_2 = ClusterOutput(scaled_evaluated_point_on_seg)

# ==== cluster RectangularGridGenerator: Grid Gen
y_axis_extent = ClusterInput()
x_axis_extent = ClusterInput()
in = ClusterInput()  # "---------------------"
origin_point = ClusterInput()
scale_y_axis = ClusterInput()
scale_x_axis = ClusterInput()
y_axis_extent_2 = Number(y_axis_extent)
x_axis_extent_2 = Number(x_axis_extent)
scale_y_axis_2 = Number(scale_y_axis)
scale_x_axis_2 = Number(scale_x_axis)
origin_point_2 = Point(origin_point)
division = Division(YAxisExtent=y_axis_extent_2, B=scale_y_axis_2)
division_2 = Division(XAxisExtent=x_axis_extent_2, B=scale_x_axis_2)
recgrid = Rectangular(Plane=origin_point_2, SizeX=scale_x_axis_2, SizeY=scale_y_axis_2, ExtentX=division_2, ExtentY=division)  # -> Cells, Points
grid_cell_curves = Curve(flatten(recgrid.Cells))
area = Area(Geometry=grid_cell_curves)  # -> Area, flatten(GridAreaCentroids)
grid_area_centroids = ClusterOutput(area.GridAreaCentroids)
grid_cell_curves_2 = ClusterOutput(grid_cell_curves)

# ==== cluster CurveAttractor: Utility
C = ClusterInput()
P = ClusterInput()
x = ClusterInput()
A = ClusterInput()
B = ClusterInput()
crv_cp = CurveClosestPoint(Point=P, Curve=C)  # -> Point, Parameter, Distance
dom = ConstructDomain(DomainStart=A, DomainEnd=B)
bnd = Bounds(Numbers=crv_cp.Distance)
remap = RemapNumbers(Value=crv_cp.Distance, Source=bnd, Target=dom)  # -> Mapped, Clipped
R = ClusterOutput(remap.Mapped)
points_on_curve = Point(crv_cp.Point)
points_on_curve_2 = ClusterOutput(points_on_curve)
